# Grasshopper definition GridGrowth.gh (Grasshopper 1.0.7)
# plug-ins: MeshEdit Components, CellGrowth, Kangaroo2 Components, Bowerbird, View_Analysis

number_slider = Slider(20, range=0..100)
number_slider_2 = Slider(10, range=0..10)

number_slider_3 = Slider(654, range=0..1000)

# ---- group: grid
# ShapedGrid
# Doubleclick Me!
grid = CSharpScript(x_Ex=number_slider, y_Ex=number_slider, size=number_slider_2)  # -> out, A; inputs x_Ex: Int32, y_Ex: Int32, size: Int32
# ---------- grid: C# ----------
    var grid = new Grid(x_Ex, y_Ex, size);
    A = grid.Pts;
# ---------- grid: C# additional code ----------
  public struct Grid
  {
    public List<Point3d> Pts;

    public Grid(int x_Ex, int y_Ex, int size)
    {
      Pts = new List<Point3d>();
      for(int i = 0; i < y_Ex; i++)
      {
        for(int j = 0; j < x_Ex; j++)
        {
          Pts.Add(new Point3d(j * size, i * size, 0));
        }
      }
    }
  }
# ---------- end grid ----------

# ---- group: rect
c_script = CSharpScript(x=number_slider, y=number_slider, size=number_slider_2)  # -> out, A; inputs x: Int32, y: Int32, size: Int32
# ---------- c_script: C# ----------
    var planeXY = new Plane(Point3d.Origin, Vector3d.ZAxis);

    A = new Rhino.Geometry.Rectangle3d(planeXY, x * size, y * size);
# ---------- end c_script ----------

# ----
c_script_2 = CSharpScript()  # -> Out, A
number_slider_4 = Slider(626, range=0..1000)

number_slider_5 = Slider(1, range=0..10, expression="x*1000")

mingridnum = Slider(2, range=0..5)

roomnum = Slider(5, range=0..10)

allpt = Point([Point(670.935879, 262.4740492, 0), Point(1258.542291, 4104.515975, 0), Point(3824.830609, 3347.88585, 0), Point(10931.44785, -596.3353225, 0), Point(11519.05426, 5098.926827, 0), Point(8761.82417, 8850.567766, 0), Point(8977.68684, 4601.721401, 0)])  # disabled
number_slider_6 = Slider(500, range=0..1000)
# ポイントから近くに点が複数あるときは枝分かれできるようにする。
# もしなければ普通に最近点（交差しない点）
number_slider_7 = Slider(10000, range=0..10000)  # disabled
number_slider_8 = Slider(5769, range=0..10000)  # disabled
pdecon = Deconstruct(Point=allpt)  # -> XComponent, YComponent, ZComponent; disabled
number_slider_9 = Slider(7, range=0..10)  # disabled
部屋形状 = Curve(<curve referenced from the Rhino model>)  # disabled
pt = ConstructPoint(XCoordinate=0, YCoordinate=0, ZCoordinate=0)
nickname = ShapedGrid(
    GridSize=number_slider_6,
    X_Ex=Slider(40, range=0..40),
    Y_Ex=Slider(40, range=0..40),
    OffsetValue=Slider(3, range=0..10, expression="x*1000"),
    OffsetValue2=Slider(6, range=0..10, expression="x*1000"),
    MaxReduceNum=Slider(6, range=0..10),
    Seed=number_slider_4,
    Origin=pt)  # -> ShapedGrid, Shape, OriginalShape, OffsetShape1, OffsetShape2
crv = Curve(nickname.Shape)
neg = Negative(Value=number_slider_6)
boundary = BoundarySurfaces(Edges=部屋形状)  # disabled

explode = Explode(Curve=nickname.Shape, Recursive=True)  # -> Segments, Vertices
crv_2 = Curve([nickname.OriginalShape, nickname.OffsetShape1, nickname.OffsetShape2])
Z = UnitZ(Factor=Slider(57, range=0..100))
pipe = Pipe(Curve=explode.Segments, Radius=1, Caps=0)
move = Move(Geometry=crv_2, Motion=Z)  # -> Geometry, Transform
lng = ListLength(List=move.Geometry)
preview = CustomPreview(Geometry=pipe, Material=ColourSwatch(SwatchColor=RGB(105, 105, 105)))
range = Range(Domain=Domain(0, 1), Steps=expr("x-1", lng))
gradient = Gradient(
    LowerLimit=0,
    UpperLimit=1,
    Parameter=range,
    stops=[0: RGB(234, 38, 0), 0.25: RGB(234, 126, 0), 0.5: RGB(254, 244, 84), 0.75: RGB(173, 203, 249), 1: RGB(75, 107, 169)])
preview_2 = CustomPreview(Geometry=move.Geometry, Material=gradient)

area = Area(Geometry=crv)  # -> Area, Centroid
dot = DotDisplay(Point=nickname.ShapedGrid)
c_script_3 = CSharpScript(shape=crv, gridSize=number_slider_6)  # -> out, offsetShape; inputs shape: Curve, gridSize: Int32
# ---------- c_script_3: C# ----------
    var plane = new Plane(AreaMassProperties.Compute(shape).Centroid, Vector3d.ZAxis);
    offsetShape = shape.Offset(plane, -gridSize, 1, CurveOffsetCornerStyle.Sharp);
# ---------- end c_script_3 ----------
offset = OffsetCurve(Curve=crv, Distance=neg, Plane=area.Centroid, Corners=1)
scale = Scale(Geometry=crv, Center=Point(0, 0, 0), Factor=0.5)  # -> Geometry, Transform
c_script_4 = CSharpScript(polyLine=c_script_3.offsetShape)  # -> out, A; inputs polyLine: Polyline
# ---------- c_script_4: C# ----------
    A = polyLine.ToArray();
# ---------- end c_script_4 ----------
number_slider_10 = Slider(20, range=0..100)  # disabled
number_slider_11 = Slider(10, range=0..10)  # disabled
初期位置何マスずらすか = Slider(8, range=0..20)
popgeo = PopulateGeometry(Geometry=boundary, Count=number_slider_9, Seed=number_slider_8)  # disabled
c_script_5 = CSharpScript(gridSize=number_slider_6, gridNum=初期位置何マスずらすか)  # -> gridArea; inputs gridSize: Int32, gridNum: Int32
# ---------- c_script_5: C# ----------
    gridArea = gridSize * gridSize * gridNum;
# ---------- end c_script_5 ----------

# ----
# カリキュラム学習時、学習難易度を上げるために。
# 答えと初期位置に違う面積の値を与える。
int = Integer(number_slider_4)
nickname_2 = AreaRatio(TargetCurve=nickname.Shape, RationMin=Slider(0.01, range=0..0.1), RoomNum=roomnum, Seed=int)  # -> Ratio, Area
nickname_3 = AreaGrowth(ShapedGrid=nickname.ShapedGrid, GridSize=number_slider_6, TargetArea=nickname_2.Area, Tolerance=c_script_5)  # -> AreaPts, AreaCenters
ma = MassAddition(Input=nickname_2.Area)  # -> Result, PartialResults
area_2 = Area(Geometry=nickname.Shape)  # -> Area, Centroid
panel = Panel(area_2.Area)
panel_2 = Panel(nickname_2.Area)
panel_3 = Panel(ma.Result)

int_2 = Integer(expr("x/2", number_slider_10))  # disabled
division = Division(A=number_slider_10, B=number_slider_11)  # disabled
neg_2 = Negative(Value=int_2)  # disabled
c_script_6 = CSharpScript(pts=popgeo)  # -> out, A, B; inputs pts: list of Point3d; disabled
# ---------- c_script_6: C# usings ----------
using System.Linq;
# ---------- c_script_6: C# ----------
    var val = pts.ToArray();
    var key = val.Select(pt => pt.X).ToArray();

    System.Array.Sort(key, val);

    A = val;
    B = key;
# ---------- end c_script_6 ----------
gridsize = Number(division)  # disabled
dom = ConstructDomain(DomainStart=int_2, DomainEnd=neg_2)  # disabled
bbint = BBIntersection()
number_slider_12 = Slider(3, range=0..10)  # disabled
rectangle = Rectangle(Plane=PlaneXY(0, 0, 0), XSize=dom, YSize=dom, Radius=0)  # -> Rectangle, Length; disabled
number_slider_13 = Slider(1801, range=0..10000)  # disabled
c_script_7 = CSharpScript(x=c_script_6.A)  # -> out, A, B; inputs x: list; disabled
# ---------- c_script_7: C# ----------
    A = x[0];
    x.RemoveAt(0);
    B = x;
# ---------- end c_script_7 ----------
cx = CurveSelf()  # -> Points, Params; disabled
crv_3 = Curve(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)  # disabled
pt_2 = Point(Point(16.01902235, 42.4646138, 0))  # disabled
pt_3 = Point(Point(-9.562098848, 5.056853245, 0))  # disabled
pt_4 = Point(Point(1.660180294, -38.22908059, 0))  # disabled
pt_5 = Point(Point(-28.80029166, -4.027848917, 0))  # disabled
number_slider_14 = Slider(1, range=0..1)  # disabled
pop2d = Populate2D(Region=rectangle.Rectangle, Count=number_slider_12, Seed=number_slider_13)  # disabled
recgrid = Rectangular(Plane=PlaneXY(0, 0, 0), SizeX=1, SizeY=2, ExtentX=10, ExtentY=5)  # -> Cells, Points; disabled
mplane = MeshPlane(Boundary=rectangle.Rectangle, WidthCount=number_slider_11, HeightCount=number_slider_11)  # -> Mesh, Area; disabled
pt_6 = Point(graft([pt_2, pt_5, pt_3, pt_4]))  # disabled
pt_7 = Point([pt_2, pt_5, pt_3, pt_4])  # disabled
c_script_8 = CSharpScript(ChosenPts=c_script_7.A, OtherPts=c_script_7.B, RoomShape=部屋形状, SearchRange=number_slider_7)  # -> out, A, B; inputs ChosenPts: list of Point3d, OtherPts: list of Point3d, RoomShape: Polyline, SearchRange: Int32; disabled
# ---------- c_script_8: C# ----------
    var chosenPts = ChosenPts;
    var otherPts = OtherPts;

    var rtnList = new List<PolylineCurve>();
    var roomShape = RoomShape.ToPolylineCurve();
    rtnList.Add(roomShape);
    ConnectNear(chosenPts[0], ref otherPts, SearchRange, ref rtnList);

    A = rtnList;
    B = otherPts;
# ---------- c_script_8: C# additional code ----------
  private void ConnectNear(Point3d stPt, ref List<Point3d> otherPts, int SearchRange, ref List<PolylineCurve> rtnList)
  {

    int iterat = 0;
    var rangePts = otherPts.Where(other => stPt.DistanceTo(other) <= SearchRange);

    //chance divide
    if(rangePts.Count() > 1)
    {
      var rand = new Random();
      iterat = rand.Next(1, rangePts.Count());
      Print("rangePts " + rangePts.Count());
      Print("iterat= " + iterat.ToString());
    }
      //if only one
    else if(rangePts.Count() == 1)
    {
      iterat = 1;
    }
      //if there is nothing
    else
    {
      return;
    }

    var newCrv = new List<PolylineCurve>();
    for(int i = 0; i < iterat; i++)
    {
      var pc = new Rhino.Geometry.PointCloud(otherPts);
      var nearIdx = pc.ClosestPoint(stPt);
      var vertices = new Point3d[2]{stPt, otherPts[nearIdx]};
      var flowCrv = new Rhino.Geometry.PolylineCurve(vertices);
      //if intersections return value is not 0 , then itersecOr = true;
      bool intersectOr = false;
      {
        foreach(var listCrv in rtnList)
        {
          flowCrv.Domain = new Interval(0, 1);
          listCrv.Domain = new Interval(0, 1);
          double v = 0.90;
          var crv1 = new PolylineCurve(new Point3d[2]{flowCrv.PointAt(1 - v), flowCrv.PointAt(v)});
          var crv2 = new PolylineCurve(new Point3d[2]{listCrv.PointAt(1 - v), listCrv.PointAt(v)});
          if( Rhino.Geometry.Intersect.Intersection.CurveCurve(crv1, crv2, 1.0, 1.0).Count != 0 )
          {
            intersectOr = true;
            break;
          }
        }
        Print(intersectOr.ToString());

        if(intersectOr == false)
        {
          rtnList.Add(flowCrv);
          otherPts.RemoveAt(nearIdx);
          newCrv.Add(flowCrv);

        }
      }
    }
    if(newCrv.Count < 1)
    {
      return;
    }
    for(int i = 0; i < newCrv.Count; i++)
    {
      ConnectNear(newCrv[i].PointAtEnd, ref otherPts, SearchRange, ref rtnList);
    }
  }
# ---------- end c_script_8 ----------
c_script_9 = CSharpScript(ChosenPts=c_script_7.A, OtherPts=c_script_7.B, RoomShape=部屋形状, SearchRange=number_slider_7)  # -> out, A, B; inputs ChosenPts: list of Point3d, OtherPts: list of Point3d, RoomShape: Polyline, SearchRange: Int32; disabled
# ---------- c_script_9: C# ----------
    var chosenPts = ChosenPts;
    var otherPts = OtherPts;

    var rtnList = new List<PolylineCurve>();
    var roomShape = RoomShape.ToPolylineCurve();
    rtnList.Add(roomShape);
    ConnectNear2(chosenPts[0], otherPts, ref rtnList);

    A = rtnList;
    B = otherPts;
# ---------- c_script_9: C# additional code ----------
  private void ConnectNear2(Point3d stPt, List<Point3d> otherPts, ref List<PolylineCurve> rtnList)
  {
   
    var distance = otherPts.Select(other => stPt.DistanceTo(other)).ToArray();
    var ptsArray = otherPts.ToArray();
    System.Array.Sort(distance, ptsArray);

    for(int i = 0; i < ptsArray.Length; i++)
    {
      var vertices = new Point3d[2]{stPt, ptsArray[i]};
      var flowCrv = new Rhino.Geometry.PolylineCurve(vertices);

      //itersect check
      bool intersectOr = false;
        foreach(var listCrv in rtnList)
         {
        flowCrv.Domain = new Interval(0, 1);
        listCrv.Domain = new Interval(0, 1);
        double v = 0.9;
        var crv1 = new PolylineCurve(new Point3d[2]{flowCrv.PointAt(1 - v), flowCrv.PointAt(v)});
        var crv2 = new PolylineCurve(new Point3d[2]{listCrv.PointAt(1 - v), listCrv.PointAt(v)});
        if( Rhino.Geometry.Intersect.Intersection.CurveCurve(crv1, crv2, 0.1, 0.1).Count != 0 )
        {
          intersectOr = true;
          break;
        }
          }

      if(intersectOr == false)
      {
        rtnList.Add(flowCrv);
        var nextPts = new List<Point3d>();
        nextPts.AddRange(ptsArray);
        nextPts.RemoveAt(i);
        Print(nextPts.Count.ToString());
        if(nextPts.Count > 0)
        {
          Print(i.ToString());
          ConnectNear2(flowCrv.PointAtEnd, nextPts, ref rtnList);
          return;
        }
     
      }
    }
  }
# ---------- end c_script_9 ----------
explode_2 = MeshExplode(Mesh=mplane.Mesh, Interpolate=False)  # disabled
cir = Circle(Plane=c_script_6.A, Radius=number_slider_7)  # disabled
mingridnum_2 = Integer(mingridnum)
dot_2 = DotDisplay(Point=pt_7)  # disabled
c_script_10 = CSharpScript(x=number_slider_6)  # -> A; inputs x: Double
# ---------- c_script_10: C# ----------
    A = Math.Sqrt((x * x) * 2);
# ---------- end c_script_10 ----------
dots = DotDisplay(Point=pt_7, Colour=RGB(0, 0, 0), Size=1)  # disabled
number_slider_15 = Slider(1, range=0..10)  # disabled
multiplication = Multiplication(A=c_script_10, B=mingridnum_2)
c_script_11 = CSharpScript(gridSize=number_slider_2)  # -> out, hypotenuse; inputs gridSize: Int32
# ---------- c_script_11: C# ----------
  hypotenuse = Math.Sqrt((gridSize * gridSize) * 2);
# ---------- end c_script_11 ----------
addition = Addition(A=c_script_10, B=multiplication)
swatch = ColourSwatch(SwatchColor=RGB(123, 0, 255))  # disabled
pt_8 = Point([<point referenced from the Rhino model> x3])
number_slider_16 = Slider(10000, range=0..10000)
series = Series(Start=0, Step=1, Count=10)
preview_3 = CustomPreview(Geometry=c_script_8.A, Material=swatch)  # disabled
number_slider_17 = Slider(10000, range=0..100000)
c_script_12 = CSharpScript(pts=pt_8, threshold=c_script_11.hypotenuse)  # -> out, clusters; inputs pts: list of Point3d, threshold: Double
# ---------- c_script_12: C# ----------
    var rtnTree = new DataTree<Point3d>();

    int pathInt = 0;
    while(pts.Count > 0)
    {
      var path = new GH_Path(pathInt);

      rtnTree.Add(pts[0], path);
      pts.RemoveAt(0);
      for(int j = 0; j < pts.Count; j++)
      {
        var distance = rtnTree.Branch(path)[0].DistanceTo(pts[j]);
        if(distance <= threshold)
        {
          rtnTree.Add(pts[j], path);
          pts.RemoveAt(j);
          j--;
        }
      }
      pathInt++;
      if(pathInt > 5000) break;
    }

    clusters = rtnTree;
# ---------- end c_script_12 ----------
c_script_13 = CSharpScript(x=series)  # -> out, A; inputs x: list
# ---------- c_script_13: C# usings ----------
using System.Linq;
public static class Extensions
{
  public static void Shuffle<T>(this IList<T> list)
  {
  for (int i = list.Count - 1; i > 0; i--)
  {
  var rand = new Random();
  int j = rand.Next(0, i + 1);
  var tmp = list[i];
  list[i] = list[j];
  list[j] = tmp;
}
}
}
# ---------- c_script_13: C# ----------
    x.Shuffle();
    A = x;
# ---------- end c_script_13 ----------
pt_9 = Point([Point(11041.6632, 1228.105722, 0), Point(11897.17929, 1217.502551, 0), Point(10772.71657, 2155.328796, 0), Point(11934.9719, 1386.351416, 0), Point(10064.65366, 993.2637524, 0)])
division_2 = Division(A=number_slider_6, B=Slider(2, range=0..10))

shape = Curve(nickname.Shape)
c_script_14 = CSharpScript(
    iStartingPositions=pt_9,
    region=c_script_3.offsetShape,
    minDist=addition,
    moveVal=division_2,
    maxIteration=number_slider_17)  # -> out, oCenters; inputs iStartingPositions: list of Point3d, region: Polyline, minDist: Int32, moveVal: Double, maxIteration: Int32
# ---------- c_script_14: C# usings ----------
using System.IO;
using System.Linq;
using System.Data;
using System.Drawing;
using System.Reflection;
using System.Windows.Forms;
using System.Xml;
using System.Xml.Linq;
using System.Runtime.InteropServices;

using Rhino.DocObjects;
using Rhino.Collections;
using GH_IO;
using GH_IO.Serialization;
# ---------- c_script_14: C# ----------
    List < Point3d > centers = new List<Point3d>();

    foreach(var pt in iStartingPositions)
    {
      if(!IsInside(pt, region))
      {
        var nearPt = region.ClosestPoint(pt);
        var vec = (nearPt - pt);
        vec.Unitize();
        nearPt += vec * moveVal;
        centers.Add(nearPt);
      }
      else
      {
        centers.Add(pt);
      }
    }

    int count = 0;
    while(true)
    {
      count++;

      if(count > maxIteration)
      {
        Print("count= " + count.ToString());
        break;
      }

      List<Vector3d> totalMoves = new List<Vector3d>();
      List<double> collisionCounts = new List<double>();

      for (int i = 0; i < centers.Count; i++)
      {
        totalMoves.Add(new Vector3d(0.0, 0.0, 0.0));
        collisionCounts.Add(0.0);
      }

      double collisionDistance = minDist;

      for (int i = 0; i < centers.Count; i++)
      {
        for (int j = i + 1; j < centers.Count; j++)
        {
          double d = centers[i].DistanceTo(centers[j]);
          if (d > collisionDistance) continue;
          Vector3d move = centers[i] - centers[j];
          move.Unitize();
          move *= moveVal;
          // move *= moveVal * (collisionDistance - d);
          totalMoves[i] += move;
          totalMoves[j] -= move;
          collisionCounts[i] += 1.0;
          collisionCounts[j] += 1.0;
        }
      }

      for (int i = 0; i < centers.Count; i++)
      {
        if (collisionCounts[i] != 0.0)
        {
          var ptBuff = centers[i];
          centers[i] += totalMoves[i] / collisionCounts[i];;
          if(!IsInside(centers[i], region))
          {
            /*
            var ptsBuff = centers;
            ptsBuff.RemoveAt(i);
            var pc = new PointCloud(ptsBuff);
            var nearIdx =  pc.ClosestPoint(ptBuff);
            var vec = ptsBuff[nearIdx]
            centers[i] =
       */
            centers[i] = ptBuff;
            //centers[i] = region.ClosestPoint(centers[i]);
          }
        }
      }

      var sum = 0.0;
      foreach(var val in collisionCounts)
      {
        sum += val;
      }

      if(sum == 0)
      {
        Print(count.ToString());
        break;
      }
    }

    oCenters = centers;
# ---------- c_script_14: C# additional code ----------
  bool IsInside (Point3d pt, Polyline crv)
  {
    Point3d pt1, pt2;
    bool oddNodes = false;

    for (int i = 0; i < crv.SegmentCount; i++) //for each contour line
    {

      pt1 = crv.SegmentAt(i).From; //get start and end pt
      pt2 = crv.SegmentAt(i).To;

      if ( (pt1[1] < pt[1] && pt2[1] >= pt[1] || pt2[1] < pt[1] && pt1[1] >= pt[1]) && (pt1[0] <= pt[0] || pt2[0] <= pt[0]) ) //if pt is between pts in y, and either of pts is before pt in x
        oddNodes ^= ( pt2[0] + (pt[1] - pt2[1]) * (pt1[0] - pt2[0]) / (pt1[1] - pt2[1]) < pt[0] ); //^= is xor
      //end.X + (pt-end).Y   * (start-end).X  /(start-end).Y   <   pt.X
    }


    if (!oddNodes)
    {
      double minDist = 1e10;
      for (int i = 0; i < crv.SegmentCount; i++) {
        Point3d cp = crv.SegmentAt(i).ClosestPoint(pt, true);
        //Point3d cp = mvContour[i].closestPoint(pt);
        //minDist = min(minDist, cp.distance(pt));
        minDist = Math.Min(minDist, cp.DistanceTo(pt));
      }
      if (minDist < 1e-10)
        return true;
    }

    if(oddNodes) return true;

    return false;
  }
# ---------- end c_script_14 ----------

crv_4 = Curve(shape)  # disabled
area_3 = Area(Geometry=crv_4)  # -> Area, Centroid; disabled
c_script_15 = CSharpScript(centers=nickname_3.AreaCenters, crv=crv_4, pt=area_3.Centroid)  # -> out, centerPts, offsetCrv; inputs centers: list of Point3d, crv: Curve, pt: Point3d, dist: Double; disabled
# ---------- c_script_15: C# ----------
    var normal = Vector3d.ZAxis;
    offsetCrv = crv.Offset(pt, normal, dist, 0.1, CurveOffsetCornerStyle.Sharp);
# ---------- end c_script_15 ----------

# ----
# 1000くらいにしておいたほうが行き止まり
# で小さい領域でない
number_slider_18 = Slider(400, range=0..1000)

c_script_16 = CSharpScript(
    iStartingPositions=pt_9,
    region=c_script_3.offsetShape,
    minDist=addition,
    moveVal=division_2,
    maxIteration=number_slider_17)  # -> out, oCenters; inputs iStartingPositions: list of Point3d, region: Polyline, minDist: Int32, moveVal: Double, maxIteration: Int32
# ---------- c_script_16: C# ----------
    List < Point3d > centers = new List<Point3d>();

    foreach(var pt in iStartingPositions)
    {
      if(!IsInside(pt, region))
      {
        var nearPt = region.ClosestPoint(pt);
        var vec = (nearPt - pt);
        vec.Unitize();
        nearPt += vec * moveVal;
        centers.Add(nearPt);
      }
      else
      {
        centers.Add(pt);
      }
    }

    int count = 0;
    while(true)
    {
      count++;

      if(count > maxIteration)
      {
        Print("count= " + count.ToString());
        break;
      }

      List<Vector3d> totalMoves = new List<Vector3d>();
      List<double> collisionCounts = new List<double>();

      for (int i = 0; i < centers.Count; i++)
      {
        totalMoves.Add(new Vector3d(0.0, 0.0, 0.0));
        collisionCounts.Add(0.0);
      }

      double collisionDistance = minDist;

      for (int i = 0; i < centers.Count; i++)
      {
        var others = centers;
        var nearWall = region.ClosestPoint(centers[i]);
        others.Add(nearWall);

        for (int j = 0; j < others.Count; j++)
        {
          if( centers[i] == others[j]) continue;

          double d = centers[i].DistanceTo(others[j]);
          if (d > collisionDistance) continue;

          Vector3d move = centers[i] - others[j];
          move.Unitize();
          move *= moveVal / 2;
          // move *= moveVal * (collisionDistance - d);
          totalMoves[i] += move;
          //totalMoves[j] -= move;
          collisionCounts[i] += 1.0;
          //collisionCounts[j] += 1.0;
        }
      }

      var sum = 0.0;
      for (int i = 0; i < centers.Count; i++)
      {
        if (collisionCounts[i] != 0.0)
        {
          var ptBuff = centers[i];
          centers[i] += totalMoves[i] / collisionCounts[i];

          if(!IsInside(centers[i], region))
          {
            centers[i] = ptBuff;
            sum++;
          }
        }
      }


      foreach(var val in collisionCounts)
      {
        sum += val;
      }

      if(sum == 0)
      {
        Print(count.ToString());
        break;
      }
    }

    oCenters = centers;
# ---------- c_script_16: C# additional code ----------
  bool IsInside (Point3d pt, Polyline crv)
  {
    Point3d pt1, pt2;
    bool oddNodes = false;

    for (int i = 0; i < crv.SegmentCount; i++) //for each contour line
    {

      pt1 = crv.SegmentAt(i).From; //get start and end pt
      pt2 = crv.SegmentAt(i).To;

      if ( (pt1[1] < pt[1] && pt2[1] >= pt[1] || pt2[1] < pt[1] && pt1[1] >= pt[1]) && (pt1[0] <= pt[0] || pt2[0] <= pt[0]) ) //if pt is between pts in y, and either of pts is before pt in x
        oddNodes ^= ( pt2[0] + (pt[1] - pt2[1]) * (pt1[0] - pt2[0]) / (pt1[1] - pt2[1]) < pt[0] ); //^= is xor
      //end.X + (pt-end).Y   * (start-end).X  /(start-end).Y   <   pt.X
    }


    if (!oddNodes)
    {
      double minDist = 1e10;
      for (int i = 0; i < crv.SegmentCount; i++) {
        Point3d cp = crv.SegmentAt(i).ClosestPoint(pt, true);
        //Point3d cp = mvContour[i].closestPoint(pt);
        //minDist = min(minDist, cp.distance(pt));
        minDist = Math.Min(minDist, cp.DistanceTo(pt));
      }
      if (minDist < 1e-10)
        return true;
    }

    if(oddNodes) return true;

    return false;
  }
# ---------- end c_script_16 ----------
c_script_17 = CSharpScript(
    iStartingPositions=nickname_3.AreaCenters,
    region=c_script_3.offsetShape,
    minDist=addition,
    moveVal=division_2,
    maxIteration=number_slider_17)  # -> out, oCenters; inputs iStartingPositions: list of Point3d, region: Polyline, minDist: Int32, moveVal: Double, maxIteration: Int32
# ---------- c_script_17: C# ----------
    List < Point3d > centers = new List<Point3d>();

    foreach(var pt in iStartingPositions)
    {
      if(!IsInside(pt, region))
      {
        var nearPt = region.ClosestPoint(pt);
        var vec = (nearPt - pt);
        vec.Unitize();
        nearPt += vec * moveVal;
        centers.Add(nearPt);
      }
      else
      {
        centers.Add(pt);
      }
    }

    int count = 0;
    while(true)
    {
      count++;

      if(count > maxIteration)
      {
        Print("count= " + count.ToString());
        break;
      }

      List<Vector3d> totalMoves = new List<Vector3d>();
      List<double> collisionCounts = new List<double>();

      for (int i = 0; i < centers.Count; i++)
      {
        totalMoves.Add(new Vector3d(0.0, 0.0, 0.0));
        collisionCounts.Add(0.0);
      }

      double collisionDistance = minDist;

      for (int i = 0; i < centers.Count; i++)
      {

        var others = new List<Point3d>(centers);
        var nearWall = region.ClosestPoint(centers[i]);
        others.Add(nearWall);

        for (int j = 0; j < others.Count; j++)
        {
          if( centers[i] == others[j]) continue;

          double d = centers[i].DistanceTo(others[j]);
          if (d > collisionDistance) continue;
          Vector3d move = centers[i] - others[j];
          move.Unitize();
          move *= moveVal;
          // move *= moveVal * (collisionDistance - d);
          totalMoves[i] += move;
          //totalMoves[j] -= move;
          collisionCounts[i] += 1.0;
          // collisionCounts[j] += 1.0;
        }
      }

      for (int i = 0; i < centers.Count; i++)
      {
        if (collisionCounts[i] != 0.0)
        {
          var ptBuff = centers[i];
          centers[i] += totalMoves[i] / collisionCounts[i];
          centers[i] = new Point3d(centers[i].X, centers[i].Y, 0);
          if(!IsInside(centers[i], region))
          {
            /*
            var ptsBuff = centers;
            ptsBuff.RemoveAt(i);
            var pc = new PointCloud(ptsBuff);
            var nearIdx =  pc.ClosestPoint(ptBuff);
            var vec = ptsBuff[nearIdx]
            centers[i] =
       */
            centers[i] = ptBuff;
            //centers[i] = region.ClosestPoint(centers[i]);
          }
        }
      }

      var sum = 0.0;
      foreach(var val in collisionCounts)
      {
        sum += val;
      }

      if(sum == 0)
      {
        Print(count.ToString());
        break;
      }
    }

    oCenters = centers;
# ---------- c_script_17: C# additional code ----------
  bool IsInside (Point3d pt, Polyline crv)
  {
    Point3d pt1, pt2;
    bool oddNodes = false;

    for (int i = 0; i < crv.SegmentCount; i++) //for each contour line
    {

      pt1 = crv.SegmentAt(i).From; //get start and end pt
      pt2 = crv.SegmentAt(i).To;

      if ( (pt1[1] < pt[1] && pt2[1] >= pt[1] || pt2[1] < pt[1] && pt1[1] >= pt[1]) && (pt1[0] <= pt[0] || pt2[0] <= pt[0]) ) //if pt is between pts in y, and either of pts is before pt in x
        oddNodes ^= ( pt2[0] + (pt[1] - pt2[1]) * (pt1[0] - pt2[0]) / (pt1[1] - pt2[1]) < pt[0] ); //^= is xor
      //end.X + (pt-end).Y   * (start-end).X  /(start-end).Y   <   pt.X
    }


    if (!oddNodes)
    {
      double minDist = 1e10;
      for (int i = 0; i < crv.SegmentCount; i++) {
        Point3d cp = crv.SegmentAt(i).ClosestPoint(pt, true);
        //Point3d cp = mvContour[i].closestPoint(pt);
        //minDist = min(minDist, cp.distance(pt));
        minDist = Math.Min(minDist, cp.DistanceTo(pt));
      }
      if (minDist < 1e-10)
        return true;
    }

    if(oddNodes) return true;

    return false;
  }
# ---------- end c_script_17 ----------
panel_4 = Panel(c_script_17.out)
con = DelaunayEdges(Points=c_script_17.oCenters, Plane=PlaneXY(0, 0, 0))  # -> Connectivity, Edges
sort = SortList(Keys=con.Edges, ValuesA=con.Edges)  # -> Keys, ValuesA
Z_2 = UnitZ(Factor=Slider(100, range=0..100))
move_2 = Move(Geometry=c_script_17.oCenters, Motion=Z_2)  # -> Geometry, Transform
number_slider_19 = Slider(592, range=0..10000)
nickname_4 = RectSelect(AreaCenter=c_script_17.oCenters, GridPts=nickname.ShapedGrid, GridSize=number_slider_6)  # -> RectPts, OtherPts, Rect
lng_2 = ListLength(List=explode_2)  # disabled
panel_5 = Panel("""5
6.5
5""")  # disabled
number_slider_20 = Slider(2, range=0..10)  # disabled
pt_10 = Point(pop2d)  # disabled
gridsize_2 = Slider(2, range=0..10)  # disabled
crv_5 = Curve(nickname_4.Rect)
dots_2 = DotDisplay(Point=move_2.Geometry, Colour=ColourSwatch(SwatchColor=RGB(255, 255, 255)), Size=number_slider_19)
dots_3 = DotDisplay(Point=nickname_3.AreaCenters, Colour=ColourSwatch(SwatchColor=RGB(0, 0, 0)), Size=number_slider_19)
nickname_5 = RectGrowth(
    RectPts=nickname_4.RectPts,
    SpacePts=nickname_4.OtherPts,
    GridSize=number_slider_6,
    TargetAreaSize=nickname_2.Area,
    Iteration=Slider(20, range=0..20),
    MingridNum=mingridnum)
nickname_6 = MakeConnectivity(
    AreaCenter=c_script_17.oCenters,
    AreaPts=nickname_3.AreaPts,
    Shape=nickname.Shape,
    GridSize=number_slider_6,
    MaxBranch=Slider(3, range=0..10),
    Seed=number_slider_4)  # -> ConnectLines, AreaBreps
number_slider_21 = Slider(0, range=0..10000)
avr = Average(Input=nickname_5)
avr_2 = Average(Input=nickname_4.RectPts)
crv_6 = Curve(nickname.Shape)
crv_7 = Curve(nickname_6.AreaBreps)
pt_11 = Point(Point(2801.686842, 12767.71966, 0))
points = PointList(Points=flatten(avr_2), Size=number_slider_21)
crv_8 = Curve(nickname.Shape)
c_script_18 = CSharpScript(pt=pt_11, curve=crv_6)  # -> out, A; inputs pt: Point3d, curve: Polyline
# ---------- c_script_18: C# ----------
    A = curve.ClosestPoint(pt);
# ---------- end c_script_18 ----------
area_4 = MeshArea(Mesh=explode_2)  # -> Area, Centroid; disabled
series_2 = Series(Start=0, Step=1, Count=lng_2)  # disabled
crv_cp = CurveClosestPoint(Curve=crv_7)  # -> Point, Parameter, Distance
points_2 = PointList(Points=flatten(avr), Size=number_slider_21)
points_3 = PointList(Points=area_4.Centroid)  # disabled
dots_4 = DotDisplay(Point=avr, Colour=ColourSwatch(SwatchColor=RGB(255, 255, 255)), Size=Slider(0, range=0..10000))
swatch_2 = ColourSwatch(SwatchColor=RGB(41, 247, 0))  # disabled
swatch_3 = ColourSwatch(SwatchColor=RGB(255, 0, 0))  # disabled
swatch_4 = ColourSwatch(SwatchColor=RGB(0, 21, 255))  # disabled
merge = Merge(Data1=nickname_6.ConnectLines, Data2=crv_8)

# ----
# カーブ全てと選択されたカーブの交点を求める。
# エンドポイントが重なっているだけの場合は無視
crv_9 = Curve(simplify(flatten(merge)))
c_script_19 = CSharpScript(crvs=crv_9)  # -> out, A; inputs crvs: list of Curve, targetIdx: Int32
# ---------- c_script_19: C# usings ----------
using System.Linq;
using Rhino.Geometry.Intersect;
# ---------- c_script_19: C# ----------
    var target = crvs[targetIdx];
    crvs.RemoveAt(targetIdx);

    A = IntersectCurves(target, crvs);
# ---------- c_script_19: C# additional code ----------
  private List<Point3d> IntersectCurves(Curve target, List<Curve> others)
  {
    var rtnList = new List<Point3d>();
    for(int i = 0; i < others.Count; i++)
    {
      var intersects = Rhino.Geometry.Intersect.Intersection.CurveCurve(target, others[i], 1, 1);
      foreach(var interEvent in intersects)
      {
        if(interEvent.IsPoint == true)
          rtnList.Add(interEvent.PointA);
      }
    }
    return rtnList;
  }
# ---------- end c_script_19 ----------
c_script_20 = CSharpScript(crvs=crv_9)  # -> out, A; inputs crvs: list of Curve
# ---------- c_script_20: C# ----------
    var endPts = new List<Point3d>();
    foreach(var crv in crvs)
    {
      endPts.Add(crv.PointAtStart);
      endPts.Add(crv.PointAtEnd);
    }

    A = endPts;
# ---------- end c_script_20 ----------
c_script_21 = CSharpScript(crvEnd=c_script_20.A, crvIntersect=c_script_19.A)  # -> out, A; inputs crvEnd: list of Point3d, crvIntersect: list of Point3d
# ---------- c_script_21: C# ----------
    A = CullContained(crvIntersect, crvEnd);
# ---------- c_script_21: C# additional code ----------
  private List<Point3d> CullContained(List<Point3d> baseList, List<Point3d> cullList)
  {
    var rtnList = baseList.Where(pt => cullList.Contains(pt) == false).ToList();

    return rtnList;
  }
# ---------- end c_script_21 ----------

cp = ClosestPoint(Point=graft(pt_7), Cloud=pt_7)  # -> ClosestPoint, CPIndex, Distance; disabled
con_2 = DelaunayEdges(Points=pt_7, Plane=PlaneXY(0, 0, 0))  # -> Connectivity, Edges; disabled
cps = ClosestPoints(Point=graft(pt_7), Cloud=pt_7, Count=number_slider_20)  # -> ClosestPoint, CPIndex, Distance; disabled
voronoi = Voronoi(Points=pt_7, Boundary=crv_3, BruteForceOverride=False)  # disabled
qt = QuadTree(Points=pt_7, Plane=crv_3, Square=number_slider_14, Group=number_slider_14)  # -> Quads, Points; disabled
voronoi_2 = Voronoi(Points=pt_7, Boundary=crv_3, BruteForceOverride=False)  # disabled
cp_2 = ClosestPoint(Point=pt_10, Cloud=area_4.Centroid)  # -> ClosestPoint, CPIndex, Distance; disabled
crv_10 = Curve(<curve referenced from the Rhino model>)  # disabled
number_slider_22 = Slider(1, range=0..1)  # disabled
dots_5 = DotDisplay(Point=graft(pt_10), Colour=graft([swatch_3, swatch_4, swatch_2]), Size=number_slider_15)  # disabled
cps_2 = ClosestPoints(Point=cp_2.ClosestPoint, Cloud=cp_2.ClosestPoint, Count=gridsize_2)  # -> ClosestPoint, CPIndex, Distance; disabled
nickname_7 = CurveIntersects(Crvs=crv_9, TargetIdx=Slider(1, range=0..10))  # -> InterPts, TargetCrv
item = ListItem(List=cps_2.ClosestPoint, Index=0, Wrap=True)  # -> Item, Item1; disabled
nickname_8 = MmToM(Mm2=nickname_2.Area)
incurve = PointInCurve(Point=c_script_17.oCenters, Curve=nickname.Shape)  # -> Relationship, Point

int_3 = Integer(expr("x/2", number_slider_6))  # disabled
neg_3 = Negative(Value=int_3)  # disabled
dom_2 = ConstructDomain(DomainStart=neg_3, DomainEnd=int_3)  # disabled
planesrf = PlaneSurface(Plane=nickname_3.AreaPts, XSize=dom_2, YSize=dom_2)  # disabled
join = BrepJoin(Breps=planesrf)  # -> Breps, Closed; disabled
# FirstSelect
number_slider_23 = Slider(0.9, range=0..1)  # disabled
tstat = TreeStatistics(Tree=join.Breps)  # -> Paths, Length, Count; disabled
range_2 = Range(Domain=number_slider_23, Steps=expr("x-1", tstat.Count))  # disabled
# GridGrowth
hsl = ColourHSL(Alpha=1, Hue=range_2, Saturation=1, Luminance=0.5)  # disabled
preview_4 = CustomPreview(Geometry=flatten(join.Breps), Material=hsl)  # disabled

equals = Equality(FirstNumber=Slider(2, range=0..10), SecondNumber=incurve.Relationship)  # -> Equality, Inequality
ma_2 = MassAddition(Input=equals.Inequality)  # -> Result, PartialResults
crvintersectspt = Panel(nickname_7.InterPts)
crvintersectspt_2 = Panel(ma_2.Result)
area_5 = Area(Geometry=nickname.OriginalShape)  # -> Area, Centroid
nickname_9 = MmToM(Mm2=area_5.Area)

dots_6 = DotDisplay(Point=c_script_17.oCenters, Colour=ColourSwatch(SwatchColor=RGB(255, 255, 255)), Size=1)  # disabled
c_script_22 = CSharpScript(pts=c_script_17.oCenters)  # -> out, A, B, C, D; inputs pts: list of Point3d; disabled
# ---------- c_script_22: C# usings ----------
using Grasshopper.Kernel.Geometry;
# ---------- c_script_22: C# ----------
    var nodes = new Node2List();
    foreach(var pt in pts)
    {
      nodes.Append(new Node2(pt.X, pt.Y));
    }

   
    
    var faces = Grasshopper.Kernel.Geometry.Delaunay.Solver.Solve_Faces(nodes, 1);

    var delMesh = Grasshopper.Kernel.Geometry.Delaunay.Solver.Solve_Mesh(nodes, 1, ref faces);
    A = delMesh;
    B = Grasshopper.Kernel.Geometry.Delaunay.Solver.Solve_Connectivity(nodes, 1, true);
    C = Grasshopper.Kernel.Geometry.Delaunay.Solver.Solve_Faces(nodes, 1);

    var edgeList = new List<Line>();
    for(int i = 0; i < delMesh.TopologyEdges.Count; i++)
    {
      edgeList.Add(delMesh.TopologyEdges.EdgeLine(i));
    }
    D = edgeList;
# ---------- end c_script_22 ----------
number_slider_24 = Slider(4, range=0..10)  # disabled
c_script_23 = CSharpScript(pts=nickname_3.AreaPts, gridSize=number_slider_6)  # -> out, A, B; inputs pts: list of Point3d, gridSize: Int32; disabled
# ---------- c_script_23: C# ----------
    var xInterval = new Interval(-(gridSize / 2), gridSize / 2);
    var yInterval = new Interval(-(gridSize / 2), gridSize / 2);


    var breps = new List<Brep>();

    foreach(var pt in pts)
    {
      var planeXY = new Plane(pt, Vector3d.ZAxis);
      var srf = new PlaneSurface(planeXY, xInterval, yInterval);
      breps.Add(srf.ToBrep());
    }
    Brep brep = Brep.JoinBreps(breps, 1)[0];
    brep.JoinNakedEdges(1);

    A = brep;

    var crv = Curve.JoinCurves(brep.DuplicateNakedEdgeCurves(true, false), 1)[0];
    B = crv;
# ---------- end c_script_23 ----------
geo = Geometry(c_script_22.D)  # disabled
swatch_5 = ColourSwatch(SwatchColor=RGB(0, 0, 0))  # disabled
c_script_24 = CSharpScript(x=geo, y=nickname.Shape)  # -> out, A; inputs x: list of Line, y: Curve, idx: Int32; disabled
# ---------- c_script_24: C# ----------
    var result = x.Select(line => Rhino.Geometry.Intersect.Intersection.CurveLine(y, line, 0.1, 0.1).Count);

    A = result.ToArray();
# ---------- end c_script_24 ----------
midpt = CurveMiddle(Curve=geo)  # disabled
equals_2 = Equality(FirstNumber=c_script_24.A, SecondNumber=number_slider_24)  # -> Equality, Inequality; disabled
cull = CullPattern(List=geo, CullPattern=equals_2.Inequality)  # disabled
number_slider_25 = Slider(0.5, range=0.01..1)  # disabled
tag = TextTag(Location=midpt, Text=c_script_24.A, Colour=swatch_5)  # disabled
geo_2 = Geometry(cull)  # disabled
crv_11 = Curve(flatten(c_script_23.B))  # disabled
move_3 = Move(Geometry=geo_2, Motion=Vector(0, 0, 10))  # -> Geometry, Transform; disabled
c_script_25 = CSharpScript(lines=flatten(geo_2), crvs=flatten(crv_11), tolerance=number_slider_25)  # -> out, A, B; inputs lines: list of Curve, crvs: list of Curve, tolerance: Double; disabled
# ---------- c_script_25: C# ----------
    var rtnList = new List<int>();

    for(int i = 0 ; i < lines.Count; i++)
    {
      int count = 0;
      for(int j = 0; j < crvs.Count; j++)
      {
        var intersectNum = Rhino.Geometry.Intersect.
          Intersection.CurveCurve(crvs[j], lines[i], tolerance, tolerance).Count;
        count += intersectNum;
      }

      rtnList.Add(count);
    }
    A = rtnList;

    var boolList = new List<bool>();
    foreach(var val in rtnList)
    {
      if(val == 2)
      {
        boolList.Add(true);
      }
      else
      {
        boolList.Add(false);
      }
    }

    B = boolList;
# ---------- end c_script_25 ----------
number_slider_26 = Slider(10, range=0..100)  # disabled
midpt_2 = CurveMiddle(Curve=move_3.Geometry)  # disabled
cull_2 = CullPattern(List=geo_2, CullPattern=c_script_25.B)  # disabled
tag_2 = TextTag3D(Location=midpt_2, Text=c_script_25.A, Size=number_slider_26, Justification=7)  # disabled
number_slider_27 = Slider(3, range=0..10)  # disabled
swatch_6 = ColourSwatch(SwatchColor=RGB(0, 0, 0))  # disabled
c_script_26 = CSharpScript(pts=flatten(c_script_17.oCenters), maxBranch=number_slider_27, lines=cull_2, seed=number_slider_4)  # -> out, A, B; inputs pts: list of Point3d, maxBranch: Int32, lines: list of Line, seed: Int32; disabled
# ---------- c_script_26: C# ----------
    var rtnTree = new DataTree<Point3d>();
    var rtnList = new List<Line>();
    var rtnTreeLine = new DataTree<Line>();


    var searchPts = new List<Point3d>();
    searchPts.AddRange(pts);
    int count = searchPts.Count;

    int idx2 = 0;
    for(int k = 0; k < searchPts.Count; k++)
    {
      Print("k " + k.ToString());
      if(searchPts.Count == 0) break;
      SortList(ref searchPts);

      Point3d ptBuff = searchPts[0];
      searchPts.RemoveAt(0);
      k--;

      var lineIdx = connectedLineidx(ptBuff, lines);
      Print(lineIdx.Count.ToString());

      if(lineIdx.Count == 0)
      {
        rtnTreeLine.Add(new Line(), new GH_Path(idx2));
        idx2++;
        continue;
      }
      if(lineIdx.Count == 1)
      {
        rtnList.Add(lines[lineIdx[0]]);
        rtnTreeLine.Add(lines[lineIdx[0]], new GH_Path(idx2));
        lines.RemoveAt(lineIdx[0]);
        if(lines.Count == 0) break;
        idx2++;
        continue;
      }

      var rand = new Random(seed);
      int randVal = rand.Next(1, lineIdx.Count);
      if(randVal > maxBranch)
      {
        randVal = maxBranch;
      }

      //important to doesnt cause error
      if(randVal == lineIdx.Count)
      {
        randVal--;
      }

      for(int i = 0; i < randVal; i++)
      {
        int idx = lineIdx[i];
        rtnList.Add(lines[idx]);
        rtnTreeLine.Add(lines[lineIdx[0]], new GH_Path(idx2));
      }
      for(int j = 0; j < randVal; j++)
      {
        int idx = lineIdx[j];
        lines.RemoveAt(idx);
      }
      if(lines.Count == 0) break;
      idx2++;
    }

    A = rtnList;
    B = rtnTreeLine;
# ---------- c_script_26: C# additional code ----------
  List<int> connectedLineidx(Point3d pt, List<Line> lines)
  {
    var rtnList = new List<int>();
    var buff = new List<int>();
    for(int i = 0; i < lines.Count; i++)
    {
      if(lines[i].From == pt || lines[i].To == pt)
      {
        buff.Add(i);
      }
    }
    var buffArr = buff.Distinct().ToArray();
    rtnList.AddRange(buffArr);

    return rtnList;
  }

  int GetClosedPt(Point3d pt, List<Point3d> SearchPts)
  {
    var keys = SearchPts.Select(sPt => pt.DistanceTo(sPt)).ToArray();
    var idxs = Enumerable.Range(0, SearchPts.Count).ToArray();
    System.Array.Sort(idxs, keys);

    return idxs[0];
  }

  void SortList(ref List<Point3d> list)
  {
    var arr = list.ToArray();
    var xArr = arr.Select(pt => pt.X).ToArray();
    var yArr = arr.Select(pt => pt.Y).ToArray();

    System.Array.Sort(arr, xArr);
    System.Array.Sort(arr, yArr);

    list.Clear();
    list.AddRange(arr);
  }
# ---------- end c_script_26 ----------
preview_5 = CustomPreview(Geometry=c_script_26.A, Material=swatch_6)  # disabled
bang = ExplodeTree(Data=c_script_26.B)  # -> Branch0, Branch1, Branch2, Branch3, Branch4, Branch5; disabled
geo_3 = Geometry(bang.Branch2)  # disabled

Y = UnitY(Factor=Slider(539, range=0..1000))
demesh = DeconstructMesh(Mesh=explode_2)  # -> simplify(Vertices), Faces, Colours, Normals; disabled
ffmpeg = Ffmpeg(DeleteOldPicture=Button(), ConvertStart=Button())  # -> out, A; inputs DeleteOldPicture: Boolean, ConvertStart: Boolean
# ---------- ffmpeg: C# usings ----------
using System.IO;
using System.Diagnostics;
using System.ComponentModel;
# ---------- ffmpeg: C# ----------
    if(DeleteOldPicture)
    {
     DeleteOldPics(ffmpegPath);
    }
   
    if(ConvertStart)
    {
      ConvertToMovie(ffmpegPath);
    }
# ---------- ffmpeg: C# additional code ----------
  const string ffmpegPath = @"C:\ffmpeg\ffmpeg-20191028-68f623d-win64-static\bin\RhinoPictures";

  private void DeleteOldPics(string ffmpegPath)
  {
    try
    {
      string[] picFiles = Directory.GetFiles(ffmpegPath, "*.png");

      foreach (string pic in picFiles)
      {
        File.Delete(pic);
      }
    }

    catch (DirectoryNotFoundException dirNotFound)
    {
      Print(dirNotFound.Message);
    }
  }


  private void ConvertToMovie(string ffmpegPath)
  {
    if (Directory.Exists(@"C:\ffmpeg\ffmpeg-20191028-68f623d-win64-static\bin\RhinoPictures\Movie\RhinoMovie.mp4"))
    {
      Directory.Delete(@"C:\ffmpeg\ffmpeg-20191028-68f623d-win64-static\bin\RhinoPictures\Movie\RhinoMovie.mp4");
    }
    try
    {
      using (Process myProcess = new Process())
      {
        myProcess.StartInfo.UseShellExecute = true;  //Shellを表示する
        myProcess.StartInfo.FileName = @"C:\ffmpeg\ffmpeg-20191028-68f623d-win64-static\bat\RhinoMovie.bat";
        myProcess.Start();
        myProcess.WaitForExit();
        Print("convert finish");
      }
    }
    catch (Exception e)
    {
      Print(e.Message);
    }
  }
# ---------- end ffmpeg ----------
swatch_7 = ColourSwatch(SwatchColor=RGB(0, 30, 255))  # disabled
ln = Line(StartPoint=item.Item, EndPoint=item.Item1)  # disabled
panel_6 = Panel("0")  # disabled
len = Length(Curve=ln)  # disabled
division_3 = Division(A=len, B=gridsize_2)  # -> flatten(Result); disabled
subtraction = Subtraction(A=division_3, B=gridsize)  # disabled
neg_4 = Negative(Value=subtraction)  # disabled
dom_3 = ConstructDomain(DomainStart=neg_4, DomainEnd=subtraction)  # disabled
item_2 = ListItem(List=pt_7, Index=cp.CPIndex, Wrap=True)  # -> flatten(Item); disabled
midpt_3 = CurveMiddle(Curve=con_2.Edges)  # disabled
cir_2 = Circle(Plane=cp_2.ClosestPoint, Radius=subtraction)  # disabled
rectangle_2 = Rectangle(Plane=cp_2.ClosestPoint, XSize=dom_3, YSize=dom_3, Radius=0)  # -> Rectangle, Length; disabled
number_slider_28 = Slider(6, range=0..10)  # disabled
item_3 = ListItem(List=rectangle_2.Rectangle, Index=0, Wrap=True)  # -> Item, Item1, Item2; disabled
preview_6 = CustomPreview(Geometry=voronoi, Material=swatch_7)  # disabled
mplane_2 = MeshPlane(Boundary=crv_10, WidthCount=10, HeightCount=10)  # -> Mesh, Area; disabled
panel_7 = Panel("C:\Users\kazuj\Desktop")  # disabled
panel_8 = Panel("Miyuu")  # disabled
incurves = PointInCurves(Point=demesh.Vertices, Curves=rectangle_2.Rectangle)  # -> Relationship, Index, Point; disabled
ln_2 = Line(StartPoint=pt_7, EndPoint=item_2)  # disabled
item_4 = ListItem(List=cps.Distance, Index=number_slider_22, Wrap=True)  # disabled
button = Button()  # disabled
pline = PolyLine(Vertices=midpt_3, Closed=False)  # disabled
number_slider_29 = Slider(0, range=0..10)  # disabled
number_slider_30 = Slider(454, range=0..1000)  # disabled
number_slider_31 = Slider(4, range=0..10)  # disabled
incurve_2 = PointInCurve(Point=demesh.Vertices, Curve=item_3.Item)  # -> Relationship, Point; disabled
incurve_3 = PointInCurve(Point=demesh.Vertices, Curve=item_3.Item1)  # -> Relationship, Point; disabled
incurve_4 = PointInCurve(Point=demesh.Vertices, Curve=item_3.Item2)  # -> Relationship, Point; disabled
explode_3 = MeshExplode(Mesh=mplane_2.Mesh, Interpolate=False)  # disabled
ma_3 = MassAddition(Input=incurves.Relationship)  # -> Result, PartialResults; disabled
swatch_8 = ColourSwatch(SwatchColor=RGB(255, 255, 255))  # disabled
crv_12 = Curve(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)  # disabled
num = Number(expr("x/2", item_4))  # disabled
lng_3 = ListLength(List=explode_3)  # disabled
preview_7 = CustomPreview(Geometry=crv_12, Material=swatch_8)  # disabled
number_slider_32 = Slider(4, range=0..10)  # disabled
number_slider_33 = Slider(24, range=0..100)  # disabled
number_slider_34 = Slider(11, range=0..100)  # disabled
explode_4 = Explode(Curve=crv_12, Recursive=True)  # -> Segments, Vertices; disabled
ma_4 = MassAddition(Input=incurve_2.Relationship)  # -> Result, PartialResults; disabled
larger = LargerThan(FirstNumber=ma_3.Result, SecondNumber=number_slider_29)  # -> flatten(LargerThan), OrEqualTo; disabled
ma_5 = MassAddition(Input=incurve_4.Relationship)  # -> Result, PartialResults; disabled
ma_6 = MassAddition(Input=incurve_3.Relationship)  # -> Result, PartialResults; disabled
nickname_10 = TextWriter(Text="I Love You", Path=panel_7, Name=panel_8, Extension="txt", Write=button)  # disabled
panel_9 = Panel("0")  # disabled
random = Random(Range=lng_3, Number=number_slider_31, Seed=number_slider_30, Integers=True)  # disabled
panel_10 = Panel("0")  # disabled
cull_3 = CullPattern(List=series_2, CullPattern=larger.LargerThan)  # disabled
cull_4 = CullPattern(List=explode_2, CullPattern=larger.LargerThan)  # disabled
larger_2 = LargerThan(FirstNumber=ma_4.Result, SecondNumber=panel_9)  # -> flatten(LargerThan), OrEqualTo; disabled
larger_3 = LargerThan(FirstNumber=ma_5.Result, SecondNumber=panel_6)  # -> flatten(LargerThan), OrEqualTo; disabled
larger_4 = LargerThan(FirstNumber=ma_6.Result, SecondNumber=panel_10)  # -> flatten(LargerThan), OrEqualTo; disabled
dom_4 = ConstructDomain(DomainStart=number_slider_34, DomainEnd=number_slider_33)  # disabled
cull_i = CullIndex(List=explode_3, Indices=random, Wrap=True)  # disabled
item_5 = ListItem(List=explode_3, Index=random, Wrap=True)  # disabled
number_slider_35 = Slider(0, range=0..1000)
number_slider_36 = Slider(13, range=0..100)  # disabled
cull_i_2 = CullIndex(List=series_2, Indices=cull_3, Wrap=True)  # disabled
random_2 = Random(Range=dom_4, Number=number_slider_32, Seed=2, Integers=True)  # disabled
cull_5 = CullPattern(List=series_2, CullPattern=larger_2.LargerThan)  # disabled
cull_6 = CullPattern(List=series_2, CullPattern=larger_3.LargerThan)  # disabled
cull_7 = CullPattern(List=series_2, CullPattern=larger_4.LargerThan)  # disabled
int_4 = Integer(expr("x/2", number_slider_2))
area_6 = MeshArea(Mesh=item_5)  # -> Area, Centroid; disabled
explode_5 = Explode(Curve=crv_10, Recursive=True)  # -> Segments, Vertices; disabled
notselectedindex = Integer(cull_i_2)  # disabled
addition_2 = Addition(A=random_2, B=number_slider_36)  # disabled
selectedindex = Integer(cull_3)  # disabled
entwine = Entwine(Branch00=cull_5, Branch01=cull_7, Branch02=cull_6, FlattenInputs=True)  # -> simplify(Result); disabled
crv_cp_2 = CurveClosestPoint(Point=area_6.Centroid, Curve=graft(explode_5.Segments))  # -> Point, Parameter, Distance; disabled
multiplication_2 = Multiplication(A=random_2)  # disabled
cir_3 = Circle(Plane=area_6.Centroid, Radius=flatten(random_2))  # disabled
midpt_4 = CurveMiddle(Curve=explode_4.Segments)  # disabled
area_7 = MeshArea(Mesh=explode_3)  # -> Area, Centroid; disabled
selectedindex_2 = Integer(entwine)  # disabled
sort_2 = SortList(Keys=crv_cp_2.Distance, ValuesA=explode_5.Segments)  # -> Keys, ValuesA; disabled
pt_12 = Point(area_4.Centroid)  # disabled
number_slider_37 = Slider(31850, range=0..1000000)  # disabled
item_6 = ListItem(List=pt_12, Index=selectedindex_2, Wrap=True)  # -> simplify(Item); disabled
rectangle_3 = Rectangle(Plane=PlaneXY(0, 0, 0), XSize=Domain(-1, 1), YSize=Domain(-2, 2), Radius=0)  # -> Rectangle, Length; disabled
rects = Point(item_6)
crv_13 = Curve(<curve referenced from the Rhino model>)  # disabled
item_7 = ListItem(List=pt_12, Index=notselectedindex, Wrap=True)  # -> simplify(Item); disabled
area_8 = Area(Geometry=crv_13)  # -> Area, Centroid; disabled
number_slider_38 = Slider(2, range=0..10)  # disabled
number_slider_39 = Slider(100, range=0..100)  # disabled
division_4 = Division(A=area_8.Area, B=number_slider_37)  # disabled
pt_13 = Point(item_7)  # disabled
pt_14 = Point(item_7)  # disabled
cir_4 = Circle(Plane=area_6.Centroid, Radius=flatten(addition_2))  # disabled
bang_2 = ExplodeTree(Data=rects)  # -> Branch0, Branch1, Branch2; disabled
panel_11 = Panel("""12
5
5""")  # disabled
nickname_11 = CellGrowth()  # -> Output, AreaCenters; disabled
number_slider_40 = Slider(0.5, range=0..1)  # disabled
pt_15 = Point(bang_2.Branch1)  # disabled
pt_16 = Point(bang_2.Branch0)  # disabled
item_8 = ListItem(List=sort_2.ValuesA, Index=0, Wrap=True)  # -> flatten(Item); disabled
swatch_9 = ColourSwatch(SwatchColor=RGB(255, 255, 255))  # disabled
series_3 = Series(Start=0, Step=1, Count=lng_3)  # disabled
incurves_2 = PointInCurves(Point=area_7.Centroid, Curves=cir_3)  # -> Relationship, Index, Point; disabled
python = GhPythonScript(pts=pt_15)  # -> out, max, min, cent; inputs pts: list of Point3d; disabled; same code as python
pt_17 = Point()  # disabled
swatch_10 = ColourSwatch(SwatchColor=RGB(41, 247, 0))  # disabled
swatch_11 = ColourSwatch(SwatchColor=RGB(255, 0, 0))  # disabled
swatch_12 = ColourSwatch(SwatchColor=RGB(0, 21, 255))  # disabled
dots_7 = DotDisplay(Colour=swatch_9, Size=number_slider_40)  # disabled
number_slider_41 = Slider(2, range=0..10)  # disabled
number_slider_42 = Slider(2, range=0..10)  # disabled
dots_8 = DotDisplay(Colour=graft([swatch_11, swatch_12, swatch_10]), Size=number_slider_40)  # disabled
swatch_13 = ColourSwatch(SwatchColor=RGBA(82, 229, 255, 35))  # disabled
cull_8 = CullPattern(List=explode_3, CullPattern=invert(incurves_2.Relationship))  # disabled
cull_9 = CullPattern(List=explode_3, CullPattern=incurves_2.Relationship)  # disabled

max = Point(python.max)  # disabled
min = Point(python.min)  # disabled
pdecon_2 = Deconstruct(Point=pt_15)  # -> XComponent, YComponent, ZComponent; disabled
pdecon_3 = Deconstruct(Point=pt_15)  # -> XComponent, YComponent, ZComponent; disabled
pdecon_4 = Deconstruct(Point=min)  # -> XComponent, YComponent, ZComponent; disabled
pdecon_5 = Deconstruct(Point=max)  # -> XComponent, YComponent, ZComponent; disabled
equals_3 = Equality(FirstNumber=pdecon_3.XComponent, SecondNumber=pdecon_4.XComponent)  # -> Equality, Inequality; disabled
equals_4 = Equality(FirstNumber=pdecon_2.XComponent, SecondNumber=pdecon_5.XComponent)  # -> Equality, Inequality; disabled
equals_5 = Equality(FirstNumber=pdecon_3.YComponent, SecondNumber=pdecon_4.YComponent)  # -> Equality, Inequality; disabled
equals_6 = Equality(FirstNumber=pdecon_2.YComponent, SecondNumber=pdecon_5.YComponent)  # -> Equality, Inequality; disabled
merge_2 = Merge(
    Data1=graft(equals_4.Equality),
    Data2=graft(equals_6.Equality),
    Data3=graft(equals_3.Equality),
    Data4=graft(equals_5.Equality))  # disabled
ma_7 = MassAddition(Input=merge_2)  # -> flatten(Result), PartialResults; disabled
cull_10 = CullPattern(List=pt_15, CullPattern=ma_7.Result)  # disabled

sqr = Square(Value=number_slider_41)  # disabled
sqr_2 = Square(Value=number_slider_42)  # disabled
toggle = BooleanToggle(True)  # disabled
area_9 = MeshArea(Mesh=cull_8)  # -> Area, Centroid; disabled
preview_8 = CustomPreview(Geometry=cull_8, Material=swatch_13)  # disabled
cull_11 = CullPattern(CullPattern=[False, False, True, True])  # disabled
addition_3 = Addition(A=sqr, B=sqr_2)  # disabled
vec2pt = Vector2Pt(PointA=python.max, PointB=python.min, Unitize=toggle)  # -> Vector, Length; disabled
vec2pt_2 = Vector2Pt(PointA=python.min, PointB=python.max, Unitize=toggle)  # -> Vector, Length; disabled
sqrt = SquareRoot(Value=addition_3)  # disabled
amp = Amplitude(Vector=vec2pt.Vector, Amplitude=sqrt)  # disabled
pt_18 = Point(pt_14)  # disabled
move_4 = Move(Geometry=python.min, Motion=amp)  # -> Geometry, Transform; disabled
nickname_12 = CellGrowth()  # -> Output, AreaCenters; disabled
pt_19 = Point()  # disabled
pdecon_6 = Deconstruct(Point=cull_10)  # -> XComponent, YComponent, ZComponent; disabled
number_slider_43 = Slider(5, range=0..10)  # disabled
num_2 = Number(pdecon_6.XComponent)  # disabled
num_3 = Number(pdecon_6.YComponent)  # disabled
number_slider_44 = Slider(3.8, range=0..10)  # disabled
sort_3 = SortList(Keys=num_3, ValuesA=num_3)  # -> Keys, ValuesA; disabled
sort_4 = SortList(Keys=num_2, ValuesA=num_2)  # -> Keys, ValuesA; disabled
cps_3 = ClosestPoints(Point=cull_10, Cloud=pt_18, Count=number_slider_43)  # -> ClosestPoint, CPIndex, Distance; disabled
cp_3 = ClosestPoint(Point=cull_10, Cloud=pt_18)  # -> ClosestPoint, CPIndex, Distance; disabled
item_9 = ListItem(List=reverse(sort_3.ValuesA), Index=0, Wrap=True)  # disabled
item_10 = ListItem(List=sort_3.ValuesA, Index=0, Wrap=True)  # disabled
item_11 = ListItem(List=reverse(sort_4.ValuesA), Index=0, Wrap=True)  # disabled
item_12 = ListItem(List=sort_4.ValuesA, Index=0, Wrap=True)  # disabled
smaller = SmallerThan(FirstNumber=cp_3.Distance, SecondNumber=number_slider_44)  # -> SmallerThan, OrEqualTo; disabled
equals_7 = Equality(FirstNumber=item_12, SecondNumber=num_2)  # -> Equality, Inequality; disabled
equals_8 = Equality(FirstNumber=item_11, SecondNumber=num_2)  # -> Equality, Inequality; disabled
equals_9 = Equality(FirstNumber=item_10, SecondNumber=num_3)  # -> Equality, Inequality; disabled
equals_10 = Equality(FirstNumber=item_9, SecondNumber=num_3)  # -> Equality, Inequality; disabled
cull_12 = CullPattern(List=cp_3.CPIndex, CullPattern=smaller.SmallerThan)  # disabled
number_slider_45 = Slider(2, range=0..10)  # disabled
cull_13 = CullPattern(List=cull_10, CullPattern=equals_7.Equality)  # disabled
cull_14 = CullPattern(List=cull_10, CullPattern=equals_8.Equality)  # disabled
cull_15 = CullPattern(List=cull_10, CullPattern=equals_9.Equality)  # disabled
cull_16 = CullPattern(List=cull_10, CullPattern=equals_10.Equality)  # disabled
# 目的の面積と一番離れているやつから
# 一番面積の広がる方向へ１進む。
# 　もし作れなかったら2番目に面積が広がる方向
# 　　で繰り返していく。
# 
# 面積の平がる確率は接点が多い辺。　なければおｋ
ma_8 = MassAddition(Input=equals_9.Equality)  # -> Result, PartialResults; disabled
item_13 = ListItem(List=pt_18, Index=cull_12, Wrap=True)  # disabled
pdecon_7 = Deconstruct(Point=cull_13)  # -> XComponent, YComponent, ZComponent; disabled
pdecon_8 = Deconstruct(Point=cull_14)  # -> XComponent, YComponent, ZComponent; disabled
pdecon_9 = Deconstruct(Point=cull_15)  # -> XComponent, YComponent, ZComponent; disabled
pdecon_10 = Deconstruct(Point=cull_16)  # -> XComponent, YComponent, ZComponent; disabled
addition_4 = Addition(A=pdecon_8.XComponent, B=number_slider_45)  # disabled
subtraction_2 = Subtraction(A=pdecon_7.XComponent, B=number_slider_45)  # disabled
addition_5 = Addition(A=pdecon_10.YComponent, B=number_slider_45)  # disabled
subtraction_3 = Subtraction(A=pdecon_9.YComponent, B=number_slider_45)  # disabled
pt_20 = ConstructPoint(XCoordinate=subtraction_2, YCoordinate=pdecon_7.YComponent, ZCoordinate=0)  # disabled
pt_21 = ConstructPoint(XCoordinate=addition_4, YCoordinate=pdecon_8.YComponent, ZCoordinate=0)  # disabled
pt_22 = ConstructPoint(XCoordinate=pdecon_10.XComponent, YCoordinate=addition_5, ZCoordinate=0)  # disabled
pt_23 = ConstructPoint(XCoordinate=pdecon_9.XComponent, YCoordinate=subtraction_3, ZCoordinate=0)  # disabled
boudingboxpt = BoudingBoxPt(pts=[pt_20, pt_21, pt_23, pt_22])  # -> out, max, min, cent; inputs pts: list of Point3d; disabled; same code as python
number_slider_46 = Slider(5, range=0..10)  # disabled
number_slider_47 = Slider(13, range=0..100)  # disabled
merge_3 = Merge(Data1=pt_20, Data2=pt_21, Data3=pt_23, Data4=pt_22)  # disabled
number_slider_48 = Slider(2, range=0..10)  # disabled
pdecon_11 = Deconstruct(Point=boudingboxpt.max)  # -> XComponent, YComponent, ZComponent; disabled
pdecon_12 = Deconstruct(Point=boudingboxpt.min)  # -> XComponent, YComponent, ZComponent; disabled
series_4 = Series(Start=0, Step=number_slider_47, Count=number_slider_46)  # disabled
series_5 = Series(Start=number_slider_48, Step=1, Count=number_slider_46)  # disabled
c_script_27 = CSharpScript()  # -> out, A, B, C; disabled
# ---------- c_script_27: C# ----------
    var array2d = new int[3][];
    A = array2d;
    B = array2d[2];
# ---------- end c_script_27 ----------
pt_24 = ConstructPoint(XCoordinate=pdecon_12.XComponent, YCoordinate=pdecon_11.YComponent, ZCoordinate=0)  # disabled
pt_25 = ConstructPoint(XCoordinate=pdecon_11.XComponent, YCoordinate=pdecon_12.YComponent, ZCoordinate=0)  # disabled
pt_26 = ConstructPoint(XCoordinate=pdecon_12.XComponent, YCoordinate=pdecon_12.YComponent, ZCoordinate=0)  # disabled
pt_27 = ConstructPoint(XCoordinate=pdecon_11.XComponent, YCoordinate=pdecon_11.YComponent, ZCoordinate=0)  # disabled
neg_5 = Negative(Value=series_4)  # disabled
planesrf_2 = PlaneSurface(Plane=PlaneXY(0, 0, 0), XSize=series_5, YSize=series_5)  # disabled
panel_12 = Panel(c_script_27.B)  # disabled
X = UnitX(Factor=neg_5)  # disabled
merge_4 = Merge(Data1=pt_27, Data2=pt_25, Data3=pt_24, Data4=pt_26)  # disabled
move_5 = Move(Geometry=planesrf_2, Motion=X)  # -> Geometry, Transform; disabled
number_slider_49 = Slider(4, range=0..100)  # disabled
jitter = Jitter(List=move_5.Geometry, Jitter=1, Seed=2)  # -> Values, Indices; disabled
area_10 = Area(Geometry=jitter.Values)  # -> Area, Centroid; disabled
merge_5 = Merge(Data1=merge_4, Data2=merge_3)  # -> flatten(Result); disabled
pt_28 = Point(pt_14)  # disabled
number_slider_50 = Slider(37, range=0..100)  # disabled
points_4 = PointList(Points=area_10.Centroid, Size=number_slider_49)  # disabled
c_script_28 = CSharpScript(x=merge_5, y=pt_28)  # -> out, A; inputs x: list of Vector3d, y: list of Vector3d; disabled; same code as c_script
c_script_29 = CSharpScript(x=jitter.Values, y=area_10.Area)  # -> out, A; inputs x: list, y: list of Int32, z: Int32; disabled
# ---------- c_script_29: C# ----------
    var areas = new List<Area>();

    for(int i = 0; i < x.Count; i++)
    {
      areas.Add(new Area(x[i], y[i]));
    }
    List<Area> test = areas.OrderBy(ar => ar.area).ToList();

    var rtnList = new List<object>();
    for(int i = 0; i < x.Count; i++)
    {
      rtnList.Add(test[i].obj);
    }
    A = rtnList;
# ---------- c_script_29: C# additional code ----------
  public class Area
  {
    public object obj {get; set;}
    public float area {get; set;}

    public Area()
    {

    }
    public Area(object obje, float val)
    {
      obj = obje;
      area = val;
    }
  }
# ---------- end c_script_29 ----------
cluster = Cluster(pt=bang_2.Branch0, pt_2=item_7)  # disabled
cluster_2 = Cluster(pt=bang_2.Branch2, pt_2=item_7)  # disabled
item_14 = ListItem(List=c_script_29.A, Index=number_slider_50, Wrap=True)  # disabled
item_15 = ListItem(List=jitter.Values, Index=number_slider_50, Wrap=True)  # disabled
cullpt = CullDuplicates(Points=cluster, Tolerance=0.1, CullMode=1)  # -> Points, Indices, Valence; disabled
cullpt_2 = CullDuplicates(Points=c_script_28.A, Tolerance=0.1, CullMode=1)  # -> Points, Indices, Valence; disabled
panel_13 = Panel(c_script_29.A)  # disabled
area_11 = Area(Geometry=c_script_29.A)  # -> Area, Centroid; disabled
preview_9 = CustomPreview(
    Geometry=[item_14, item_15],
    Material={diffuse=RGB(221, 160, 221), emission=RGB(66, 48, 66), shine=0.5, specular=RGB(255, 255, 255), transparency=0})  # disabled
pt_29 = Point(c_script_28.A)  # disabled
pt_30 = Point(cullpt.Points)  # disabled
pt_31 = Point(cluster_2)  # disabled
points_5 = PointList(Points=area_11.Centroid, Size=number_slider_49)  # disabled
c_script_30 = CSharpScript(x=pt_30, y=pt_29)  # -> out, A; inputs x: list of Vector3d, y: list of Vector3d; disabled; same code as c_script
pt_32 = Point(c_script_30.A)  # disabled
cullpt_3 = CullDuplicates(Points=pt_32, Tolerance=0.1, CullMode=1)  # -> Points, Indices, Valence; disabled
item_16 = ListItem(List=cullpt_3.Points, Index=0, Wrap=True)  # -> Item, Item1; disabled

pt_33 = Point(item_16.Item1)  # disabled
pdecon_13 = Deconstruct(Point=pt_33)  # -> XComponent, YComponent, ZComponent; disabled
pdecon_14 = Deconstruct(Point=pt_30)  # -> XComponent, YComponent, ZComponent; disabled
number_slider_51 = Slider(2, range=0..10)  # disabled
equals_11 = Equality(FirstNumber=pdecon_14.YComponent, SecondNumber=pdecon_13.YComponent)  # -> Equality, Inequality; disabled
equals_12 = Equality(FirstNumber=pdecon_14.XComponent, SecondNumber=pdecon_13.XComponent)  # -> Equality, Inequality; disabled
c_script_31 = CSharpScript(x=pdecon_14.YComponent, y=pdecon_13.YComponent)  # -> out, A; inputs x: Int32, y: list of Int32; disabled
# ---------- c_script_31: C# ----------
    A = y.Contains(x);
# ---------- end c_script_31 ----------
ma_9 = MassAddition(Input=equals_11.Equality)  # -> Result, PartialResults; disabled
ma_10 = MassAddition(Input=equals_12.Equality)  # -> Result, PartialResults; disabled
c_script_32 = CSharpScript(x=pdecon_14.XComponent, y=pdecon_13.XComponent)  # -> out, A; inputs x: Int32, y: list of Int32; disabled; same code as c_script_31
larger_5 = LargerThan(FirstNumber=ma_10.Result, SecondNumber=number_slider_51)  # -> LargerThan, OrEqualTo; disabled
larger_6 = LargerThan(FirstNumber=ma_9.Result, SecondNumber=number_slider_51)  # -> LargerThan, OrEqualTo; disabled
and = GateAnd(A=c_script_32.A, B=larger_5.LargerThan)  # disabled
and_2 = GateAnd(A=c_script_31.A, B=larger_6.LargerThan)  # disabled
or = GateOr(A=and, B=and_2)  # disabled

pt_34 = Point(item_16.Item)  # disabled
pdecon_15 = Deconstruct(Point=pt_34)  # -> XComponent, YComponent, ZComponent; disabled
pdecon_16 = Deconstruct(Point=pt_30)  # -> XComponent, YComponent, ZComponent; disabled
number_slider_52 = Slider(2, range=0..10)  # disabled
equals_13 = Equality(FirstNumber=pdecon_16.YComponent, SecondNumber=pdecon_15.YComponent)  # -> Equality, Inequality; disabled
equals_14 = Equality(FirstNumber=pdecon_16.XComponent, SecondNumber=pdecon_15.XComponent)  # -> Equality, Inequality; disabled
c_script_33 = CSharpScript(x=pdecon_16.YComponent, y=pdecon_15.YComponent)  # -> out, A; inputs x: Int32, y: list of Int32; disabled; same code as c_script_31
ma_11 = MassAddition(Input=equals_13.Equality)  # -> Result, PartialResults; disabled
ma_12 = MassAddition(Input=equals_14.Equality)  # -> Result, PartialResults; disabled
c_script_34 = CSharpScript(x=pdecon_16.XComponent, y=pdecon_15.XComponent)  # -> out, A; inputs x: Int32, y: list of Int32; disabled; same code as c_script_31
larger_7 = LargerThan(FirstNumber=ma_12.Result, SecondNumber=number_slider_52)  # -> LargerThan, OrEqualTo; disabled
larger_8 = LargerThan(FirstNumber=ma_11.Result, SecondNumber=number_slider_52)  # -> LargerThan, OrEqualTo; disabled
and_3 = GateAnd(A=c_script_34.A, B=larger_7.LargerThan)  # disabled
and_4 = GateAnd(A=c_script_33.A, B=larger_8.LargerThan)  # disabled
or_2 = GateOr(A=and_3, B=and_4)  # disabled
or_3 = GateOr(A=or_2, B=or)  # disabled
# RectanglerGrowth
cull_17 = CullPattern(List=pt_30, CullPattern=invert(or_3))  # disabled

area_12 = Area(Geometry=c_script.A)  # -> Area, Centroid
c_script_35 = CSharpScript(x=number_slider, y=number_slider, center=area_12.Centroid, size=number_slider_2, offset=Slider(30, range=0..100))  # -> out, A; inputs x: Int32, y: Int32, center: Point3d, size: Int32, offset: Int32
# ---------- c_script_35: C# ----------
    var planeXY = new Plane(center, Vector3d.ZAxis);
    var xInter = new Interval(((x * size) - offset) * (-0.5), ((x * size) - offset) * 0.5);
    var yInter = new Interval(((y * size) - offset) * (-0.5), ((y * size) - offset) * 0.5);
    A = new Rhino.Geometry.Rectangle3d(planeXY, xInter, yInter);
# ---------- end c_script_35 ----------
pop2d_2 = Populate2D(Region=c_script_35.A, Count=Slider(6, range=0..10), Seed=number_slider_3)

# ---- group: SepRect
c_script_36 = CSharpScript(rect=c_script.A, sepPts=pop2d_2)  # -> out, A; inputs rect: Rectangle3d, sepPts: list of Point3d
# ---------- c_script_36: C# ----------
    var corners = new List<Point3d>();

    for(int i = 0; i < 4; i++)
      corners.Add(rect.Corner(i));

    var pc = new PointCloud(corners);

    var planeXY = new Plane(Point3d.Origin, Vector3d.ZAxis);
    var ExclusionArea = new List<Rectangle3d>();

    for(int i = 0; i < sepPts.Count; i++)
    {
      var closestIdx = pc.ClosestPoint(sepPts[i]);
      var area = new Rectangle3d(planeXY, sepPts[i], corners[closestIdx]);
      ExclusionArea.Add(area);
    }
    A = ExclusionArea;
# ---------- end c_script_36 ----------

# ----
c_script_37 = CSharpScript(x=c_script.A, y=c_script_36.A)  # -> out, A; inputs x: Polyline, y: list of Curve
# ---------- c_script_37: C# ----------
    x.ToPolylineCurve();
    A = Curve.CreateBooleanDifference(x.ToPolylineCurve(),　 y, 0.1);
# ---------- end c_script_37 ----------

# ---- group: alivets
rdiff = RegionDifference(CurvesA=c_script.A, CurvesB=c_script_36.A)
incurve_5 = PointInCurve(Point=grid.A, Curve=rdiff)  # -> Relationship, Point
cull_18 = CullPattern(List=grid.A, CullPattern=incurve_5.Relationship)

c_script_38 = CSharpScript(gridPts=grid.A, excArea=c_script_36.A)  # -> out, A, B; inputs gridPts: list of Point3d, excArea: list of Rectangle3d; disabled
# ---------- c_script_38: C# ----------
    var rtnList = new List<Point3d>();
    var planeXY = new Plane(Point3d.Origin, Vector3d.ZAxis);

    for(int i = 0; i < gridPts.Count; i++)
    {
      int count = 0;
      for(int j = 0; j < excArea.Count; j++)
      {
        if(IsInside(gridPts[i], excArea[j].ToPolyline()))
        {
          count++;
        }
      }
      Print(count.ToString());
      if(count == 0)
        rtnList.Add(gridPts[i]);
    }

    A = rtnList;
    B = excArea[0].ToPolyline().IsClosed;
# ---------- c_script_38: C# additional code ----------
  bool IsInside (Point3d pt, Polyline crv)
  {
    Point3d pt1, pt2;
    bool oddNodes = false;

    for (int i = 0; i < crv.SegmentCount; i++) //for each contour line
    {

      pt1 = crv.SegmentAt(i).From; //get start and end pt
      pt2 = crv.SegmentAt(i).To;

      if ( (pt1[1] < pt[1] && pt2[1] >= pt[1] || pt2[1] < pt[1] && pt1[1] >= pt[1]) && (pt1[0] <= pt[0] || pt2[0] <= pt[0]) ) //if pt is between pts in y, and either of pts is before pt in x
        oddNodes ^= ( pt2[0] + (pt[1] - pt2[1]) * (pt1[0] - pt2[0]) / (pt1[1] - pt2[1]) < pt[0] ); //^= is xor
      //end.X + (pt-end).Y   * (start-end).X  /(start-end).Y   <   pt.X
    }


    if (!oddNodes)
    {
      double minDist = 1e10;
      for (int i = 0; i < crv.SegmentCount; i++) {
        Point3d cp = crv.SegmentAt(i).ClosestPoint(pt, true);
        //Point3d cp = mvContour[i].closestPoint(pt);
        //minDist = min(minDist, cp.distance(pt));
        minDist = Math.Min(minDist, cp.DistanceTo(pt));
      }
      if (minDist < 1e-10)
        return true;
    }

    if(oddNodes) return true;

    return false;
  }
# ---------- end c_script_38 ----------

# ----
c_script_39 = CSharpScript(x=c_script_37.A)  # -> out, A; inputs x: Curve
# ---------- c_script_39: C# ----------
    var poly = new Polyline();
    x.TryGetPolyline(out poly);
    A = poly;
# ---------- end c_script_39 ----------

pt_35 = Point(cull_18)

# ----
# たまにOtherPtsが二つにわかれるせいでうまくいかない
# ときがあるが、グループｐｔと同じ機能使えば面積の
# 大きいほうから処理できる。
# 
# ただ、時間がないからトリマ放置
crv_14 = Curve([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])  # disabled
number_slider_53 = Slider(2, range=0..10)  # disabled
incurves_3 = PointInCurves(Point=pt_35, Curves=crv_14)  # -> Relationship, Index, Point; disabled
equals_15 = Equality(FirstNumber=number_slider_53, SecondNumber=incurves_3.Relationship)  # -> Equality, Inequality; disabled
number_slider_54 = Slider(11, range=0..100)  # disabled
cull_19 = CullPattern(List=pt_35, CullPattern=equals_15.Equality)  # disabled
# AreaGrowth
c_script_40 = CSharpScript(pts=cull_19)  # -> out, groupPt; inputs pts: list of Point3d; disabled
# ---------- c_script_40: C# additional code ----------
  DataTree<Point3d> GroupPts(List<Point3d> pts, double gridSize)
  {
  
  }
# ---------- end c_script_40 ----------
pgroups = PointGroups(Points=cull_19, Distance=number_slider_54)  # -> GroupPt, Indices; disabled

# ----
# AreaRatio
area_13 = Area(Geometry=rdiff)  # -> Area, Centroid

roomnum_2 = Slider(6, range=0..10)
c_script_41 = CSharpScript(area=area_13.Area, ratioMin=Slider(0.1, range=0..0.1), roomNum=roomnum_2, seed=number_slider_3)  # -> out, Area, B; inputs area: Double, ratioMin: Double, roomNum: Int32, seed: Int32
# ---------- c_script_41: C# ----------
    var rtnList = new List<double>();
    var ratioList = new List<double>();

    double rationMax = 1f / (float) (roomNum);
    for(int i = 0; i < roomNum - 1; i++)
    {
      var rand = new Random(seed * i);
      var randVal = rand.NextDouble() * (rationMax - ratioMin) + ratioMin;
      ratioList.Add(randVal);
    }
    ratioList.Add(1 - ratioList.Sum());

    var areaArr = ratioList.Select(ratio => ratio * area).ToArray();
    rtnList.AddRange(areaArr);

    Area = rtnList;
    B = ratioList;
# ---------- end c_script_41 ----------
panel_14 = Panel(area_13.Area)
jitter_2 = Jitter(List=c_script_41.Area, Jitter=1, Seed=number_slider_3)  # -> Values, Indices
ma_13 = MassAddition(Input=jitter_2.Values)  # -> Result, PartialResults
panel_15 = Panel(ma_13.Result)

nickname_13 = AreaGrowth(Others=pt_35, GridSize=number_slider_2, TargetArea=jitter_2.Values, Tolerance=number_slider_18)  # -> Output, AreaCenters

int_5 = Integer(expr("x/2", number_slider_2))
neg_6 = Negative(Value=int_5)
avr_3 = Average(Input=nickname_13.Output)
dom_5 = ConstructDomain(DomainStart=neg_6, DomainEnd=int_5)
planesrf_3 = PlaneSurface(Plane=nickname_13.Output, XSize=dom_5, YSize=dom_5)
join_2 = BrepJoin(Breps=planesrf_3)  # -> Breps, Closed

dots_9 = DotDisplay(Point=avr_3, Colour=ColourSwatch(SwatchColor=RGB(255, 255, 255)), Size=Slider(3, range=0..10))

pt_36 = Point(avr_3)
con_3 = DelaunayEdges(Points=flatten(pt_36), Plane=PlaneXY(0, 0, 0))  # -> Connectivity, Edges
explode_6 = Explode(Curve=rdiff, Recursive=True)  # -> Segments, Vertices
ccx = CurveCurve(CurveA=graft(con_3.Edges), CurveB=flatten(explode_6.Segments))  # -> simplify(Points), ParamsA, ParamsB
pshift = ShiftPaths(Data=ccx.Points, Offset=-1)
number_slider_55 = Slider(28, range=0..1000)
lng_4 = ListLength(List=pshift)  # -> flatten(Length)
equals_16 = Equality(FirstNumber=flatten(lng_4), SecondNumber=Slider(0, range=0..100))  # -> Equality, Inequality
cull_20 = CullPattern(List=con_3.Edges, CullPattern=flatten(equals_16.Equality))
jitter_3 = Jitter(List=cull_20, Jitter=1, Seed=number_slider_55)  # -> Values, Indices

int_6 = Integer(jitter_2.Values)
concat = Concatenate(FragmentA="Desired :", FragmentB=int_6)

number_slider_56 = Slider(0, range=0..1000)
pt_37 = Point(nickname_5)
int_7 = Integer(expr("x/2", number_slider_6))
cluster_3 = Cluster_2(
    I=pt_37,
    F_2=number_slider_56,
    F=Slider(813, range=0..1000),
    F_4=number_slider_56,
    P=pt_37,
    x=int_7,
    B=int_7,
    F_3=number_slider_56,
    T=pt_37)  # -> G, G_3, A, G_2, C
swatch_14 = ColourSwatch(SwatchColor=RGB(0, 0, 0))
int_8 = Integer(nickname_8)
concat_2 = Concatenate(FragmentA="Desired :", FragmentB=int_8)
preview_10 = CustomPreview(Geometry=flatten(cluster_3.G_2), Material=cluster_3.C)
tag_3 = TextTag(Location=flatten(cluster_3.G), Text=flatten(concat_2), Colour=swatch_14)

nickname_14 = MmToM(Mm2=cluster_3.A)

int_9 = Integer(nickname_14)
concat_3 = Concatenate(FragmentA="Current :", FragmentB=int_9)
subtraction_4 = Subtraction(A=int_8, B=int_9)
tag_4 = TextTag(Location=flatten(cluster_3.G_3), Text=flatten(concat_3), Colour=swatch_14)
tag_5 = TextTag(Location=flatten(cluster_3.G), Text=flatten(subtraction_4))

wires = BrepWireframe(Brep=cluster_3.G_2, Density=-1)
subtraction_5 = Subtraction(A=int_8, B=int_9)
abs = Absolute(Value=subtraction_5)
division_5 = Division(A=abs, B=nickname_9)
move_6 = Move(Geometry=cluster_3.G, Motion=Y)  # -> Geometry, Transform
neg_7 = Negative(Value=division_5)
panel_16 = Panel(neg_7)
tag_6 = TextTag(Location=flatten(move_6.Geometry), Text=flatten(division_5), Colour=swatch_14)

# ----
# 接続性分かれるけど、
# 多分こいつらどこでもいい
# っていうセットがあるはずだから別にいい。
lng_5 = ListLength(List=nickname_13.Output)
multiplication_3 = Multiplication(A=number_slider_2, B=number_slider_2)
item_17 = ListItem(List=flatten(join_2.Breps), Index=0, Wrap=True)
multiplication_4 = Multiplication(A=lng_5, B=multiplication_3)  # -> flatten(Result)
swatch_15 = ColourSwatch(SwatchColor=RGB(255, 255, 255))
swatch_16 = ColourSwatch(SwatchColor=RGB(0, 0, 0))
tstat_2 = TreeStatistics(Tree=nickname_13.Output)  # -> Paths, Length, Count
crv_15 = Curve(join_2.Breps)
ccx_2 = CurveCurve(CurveA=graft(jitter_3.Values), CurveB=flatten(crv_15))  # -> Points, ParamsA, ParamsB
pshift_2 = ShiftPaths(Data=ccx_2.Points, Offset=-1)
lng_6 = ListLength(List=pshift_2)  # -> flatten(Length)
equals_17 = Equality(FirstNumber=lng_6, SecondNumber=Slider(2, range=0..10))  # -> Equality, Inequality
range_3 = Range(Domain=Slider(0.9, range=0..1), Steps=expr("x-1", tstat_2.Count))
cull_21 = CullPattern(List=jitter_3.Values, CullPattern=equals_17.Equality)
hsl_2 = ColourHSL(Alpha=1, Hue=range_3, Saturation=1, Luminance=0.5)
Y_2 = UnitY(Factor=Slider(5, range=0..10))
c_script_42 = CSharpScript(seed=Slider(958, range=0..1000))  # -> out, A; inputs seed: Int32
# ---------- c_script_42: C# ----------
    var rand = new Random(seed);
    int randVal = rand.Next(0, 5);
    
    A = randVal;
# ---------- end c_script_42 ----------
panel_17 = Panel(equals_17.Inequality)
move_7 = Move(Geometry=avr_3, Motion=Y_2)  # -> Geometry, Transform
cloud = CloudDisplay(Points=nickname_13.Output, Colours=graft(hsl_2), Size=Slider(6, range=0..10), SpriteType=0)
int_10 = Integer(jitter_2.Values)
int_11 = Integer(multiplication_4)
concat_4 = Concatenate(FragmentA="Desired :", FragmentB=int_10)
concat_5 = Concatenate(FragmentA="Current :", FragmentB=int_11)

c_script_43 = CSharpScript(pts=flatten(pt_36), maxBranch=Slider(3, range=0..10), lines=cull_21, seed=number_slider_55)  # -> out, A; inputs pts: list of Point3d, maxBranch: Int32, lines: list of Line, seed: Int32
# ---------- c_script_43: C# ----------
    var rtnTree = new DataTree<Point3d>();
    var rtnList = new List<Line>();

    var searchPts = new List<Point3d>();
    searchPts.AddRange(pts);
    int count = searchPts.Count;

    for(int k = 0; k < searchPts.Count; k++)
    {
      Print("k " + k.ToString());
      if(searchPts.Count == 0) break;
      SortList(ref searchPts);

      Point3d ptBuff = searchPts[0];
      searchPts.RemoveAt(0);
      k--;

      var lineIdx = connectedLineidx(ptBuff, lines);
      Print(lineIdx.Count.ToString());

      if(lineIdx.Count == 0)
      {
        continue;
      }
      if(lineIdx.Count == 1)
      {
        rtnList.Add(lines[lineIdx[0]]);
        lines.RemoveAt(lineIdx[0]);
        if(lines.Count == 0) break;
        continue;
      }

      var rand = new Random(seed);
      int randVal = rand.Next(1, lineIdx.Count);
      if(randVal > maxBranch)
      {
        randVal = maxBranch;
      }

      //important to doesnt cause error
      if(randVal == lineIdx.Count)
      {
        randVal--;
      }

      for(int i = 0; i < randVal; i++)
      {
        int idx = lineIdx[i];
        rtnList.Add(lines[idx]);
      }
      for(int j = 0; j < randVal; j++)
      {
        int idx = lineIdx[j];
        lines.RemoveAt(idx);
      }
      if(lines.Count == 0) break;
    }

    A = rtnList;
# ---------- c_script_43: C# additional code ----------
  List<int> connectedLineidx(Point3d pt, List<Line> lines)
  {
    var rtnList = new List<int>();
    var buff = new List<int>();
    for(int i = 0; i < lines.Count; i++)
    {
      if(lines[i].From == pt || lines[i].To == pt)
      {
        buff.Add(i);
      }
    }
    var buffArr = buff.Distinct().ToArray();
    rtnList.AddRange(buffArr);

    return rtnList;
  }

  int GetClosedPt(Point3d pt, List<Point3d> SearchPts)
  {
    var keys = SearchPts.Select(sPt => pt.DistanceTo(sPt)).ToArray();
    var idxs = Enumerable.Range(0, SearchPts.Count).ToArray();
    System.Array.Sort(idxs, keys);

    return idxs[0];
  }

  void SortList(ref List<Point3d> list)
  {
    var arr = list.ToArray();
    var xArr = arr.Select(pt => pt.X).ToArray();
    var yArr = arr.Select(pt => pt.Y).ToArray();

    System.Array.Sort(arr, xArr);
    System.Array.Sort(arr, yArr);

    list.Clear();
    list.AddRange(arr);
  }
# ---------- end c_script_43 ----------

panel_18 = Panel(c_script_43.out)
preview_11 = CustomPreview(Geometry=c_script_43.A, Material=ColourSwatch(SwatchColor=RGB(0, 0, 0)))
join_3 = JoinCurves(Curves=c_script_43.A, Preserve=False)  # disabled
item_18 = ListItem(List=join_3, Index=0, Wrap=True)  # -> Item, Item1; disabled
explode_7 = Explode(Curve=item_18.Item1, Recursive=True)  # -> Segments, Vertices; disabled
pcen = PolygonCenter(Polyline=item_18.Item)  # -> CenterV, CenterE, CenterA; disabled
explode_8 = Explode(Curve=item_18.Item, Recursive=True)  # -> Segments, Vertices; disabled
cp_4 = ClosestPoint(Point=pcen.CenterV, Cloud=explode_7.Vertices)  # -> ClosestPoint, CPIndex, Distance; disabled
cp_5 = ClosestPoint(Point=cp_4.ClosestPoint, Cloud=explode_8.Vertices)  # -> ClosestPoint, CPIndex, Distance; disabled
ln_3 = Line(StartPoint=cp_5.ClosestPoint, EndPoint=cp_4.ClosestPoint)  # disabled

preview_12 = CustomPreview(Geometry=flatten(join_2.Breps), Material=hsl_2)
tag_7 = TextTag(Location=flatten(avr_3), Text=concat_4, Colour=swatch_16)
tag_8 = TextTag(Location=flatten(move_7.Geometry), Text=concat_5, Colour=swatch_16)

division_6 = Division(A=number_slider_2, B=Slider(1, range=0..10))

# ----
# Rectangleないの
# ＰｔｓをＴｒｅｅｎｉ分ける
pt_38 = Point(flatten(avr_3))
pt_39 = Point(pt_35)

c_script_44 = CSharpScript(pts=pt_38)  # -> out, A; inputs pts: list of Point3d
# ---------- c_script_44: C# ----------
    var rtnList = new List<double>();

    for(int i = 0; i < pts.Count; i++)
    {
      var ptList = new List<Point3d>(pts);
      ptList.RemoveAt(i);
      var pc = new PointCloud(ptList);
      var closestIdx = pc.ClosestPoint(pts[i]);

      rtnList.Add(pts[i].DistanceTo(ptList[closestIdx]));
    }

    A = rtnList;
# ---------- end c_script_44 ----------
c_script_45 = CSharpScript(dist=c_script_44.A, gridSize=division_6)  # -> out, A; inputs dist: list of Double, gridSize: Double
# ---------- c_script_45: C# ----------
    var rtnList = new List<Interval>();

    for(int i = 0; i < dist.Count; i++)
    {
      var interValue = (dist[i] / 2) - gridSize;
      var inter = new Interval(interValue * -1, interValue);
      rtnList.Add(inter);
    }

    A = rtnList;
# ---------- end c_script_45 ----------
# MakeConnectivity
rectangle_4 = Rectangle(Plane=pt_38, XSize=c_script_45.A, YSize=c_script_45.A, Radius=0)  # -> Rectangle, Length

c_script_46 = CSharpScript(gridPts=pt_39, excArea=rectangle_4.Rectangle)  # -> out, A, B, C, D, rectPT; inputs gridPts: list of Point3d, excArea: list of Rectangle3d
# ---------- c_script_46: C# ----------
    var rtnList = new List<Point3d>();
    var rtnListB = new List<List<Point3d>>();
    var planeXY = new Plane(Point3d.Origin, Vector3d.ZAxis);
    var rectPts = new DataTree<Point3d>();

    for(int i = 0; i < excArea.Count;　i++)
    {
      var list = new List<Point3d>();
      rtnListB.Add(list);
    }
    Print(rtnListB.Count.ToString());

    for(int i = 0; i < gridPts.Count; i++)
    {
      int count = 0;
      for(int j = 0;j < excArea.Count; j++)
      {
        if(IsInside(gridPts[i], excArea[j].ToPolyline()))
        {
          count++;
          rectPts.Add(gridPts[i], new GH_Path(j));
          rtnListB[j].Add(gridPts[i]);
        }
        else
        {

        }
      }

      if(count == 0)
      {
        rtnList.Add(gridPts[i]);
      }
    }

    A = rtnList;
    B = rtnListB[0];
    C = rtnListB[1];
    D = rtnListB[2];
    rectPT = rectPts;
# ---------- c_script_46: C# additional code ----------
  bool IsInside (Point3d pt, Polyline crv)
  {
    Point3d pt1, pt2;
    bool oddNodes = false;

    for (int i = 0; i < crv.SegmentCount; i++) //for each contour line
    {

      pt1 = crv.SegmentAt(i).From; //get start and end pt
      pt2 = crv.SegmentAt(i).To;

      if ( (pt1[1] < pt[1] && pt2[1] >= pt[1] || pt2[1] < pt[1] && pt1[1] >= pt[1]) && (pt1[0] <= pt[0] || pt2[0] <= pt[0]) ) //if pt is between pts in y, and either of pts is before pt in x
        oddNodes ^= ( pt2[0] + (pt[1] - pt2[1]) * (pt1[0] - pt2[0]) / (pt1[1] - pt2[1]) < pt[0] ); //^= is xor
      //end.X + (pt-end).Y   * (start-end).X  /(start-end).Y   <   pt.X
    }


    if (!oddNodes)
    {
      double minDist = 1e10;
      for (int i = 0; i < crv.SegmentCount; i++) {
        Point3d cp = crv.SegmentAt(i).ClosestPoint(pt, true);
        //Point3d cp = mvContour[i].closestPoint(pt);
        //minDist = min(minDist, cp.distance(pt));
        minDist = Math.Min(minDist, cp.DistanceTo(pt));
      }
      if (minDist < 1e-10)
        return true;
    }

    if(oddNodes) return true;

    return false;
  }
# ---------- end c_script_46 ----------

# ----
# grid を成長させていき
# それぞれのエリアに分ける
number_slider_57 = Slider(0, range=0..10)
gridsize_3 = Integer(number_slider_2)
nickname_15 = GrowthRect2(
    RectPts=c_script_46.rectPT,
    SpacePts=c_script_46.A,
    GridSize=gridsize_3,
    TargetAreaSize=jitter_2.Values,
    Iteration=Slider(10000, range=0..10000),
    MingridNum=number_slider_57)  # disabled
pt_40 = Point(nickname_15)

bang_3 = ExplodeTree(Data=c_script_46.rectPT)  # -> Branch0, Branch1; disabled
pt_41 = Point(bang_3.Branch0)  # disabled
c_script_47 = CSharpScript(pts=bang_3.Branch0, index=number_slider_28, gridSize=number_slider_2)  # -> out, neighbour; inputs pts: list of Point3d, index: Int32, gridSize: Int32; disabled
# ---------- c_script_47: C# ----------
    neighbour = GetNeighbour(pts[index], pts, gridSize);
# ---------- c_script_47: C# additional code ----------
  List<Point3d> GetNeighbour(Point3d pt, List<Point3d> pts, int gridSize)
  {
    var rtnList = new List<Point3d>();

    var neighbour = new List<Point3d>();
    neighbour.Add(pt + new Vector3d(gridSize, 0, 0));
    neighbour.Add(pt + new Vector3d(-gridSize, 0, 0));
    neighbour.Add(pt + new Vector3d(0, gridSize, 0));
    neighbour.Add(pt + new Vector3d(0, -gridSize, 0));

    var rtnArr = neighbour.Where(neigh => pts.Contains(neigh)).ToArray();
    rtnList.AddRange(rtnArr);

    return rtnList;
  }
# ---------- end c_script_47 ----------

# ---- group: get neigh
c_script_48 = CSharpScript(pts=bang_3.Branch0, index=number_slider_28, gridSize=number_slider_2)  # -> out, neighbour; inputs pts: list of Point3d, index: Int32, gridSize: Int32; disabled; same code as c_script_47

# ----
dot_3 = DotDisplay(Point=bang_3.Branch1)  # disabled
item_19 = ListItem(List=bang_3.Branch0, Index=number_slider_28, Wrap=True)  # disabled
cluster_4 = Cluster_2(I=pt_40, F_2=number_slider_35, F=1, F_4=number_slider_35, P=pt_40, x=int_4, B=int_4, F_3=number_slider_35, T=pt_40)  # -> G, G_3, A, G_2, C
int_12 = Integer(cluster_4.A)
concat_6 = Concatenate(FragmentA="Current :", FragmentB=int_12)
preview_13 = CustomPreview(Geometry=flatten(cluster_4.G_2), Material=cluster_4.C)
tag_9 = TextTag(Location=flatten(cluster_4.G_3), Text=flatten(concat_6), Colour=swatch_16)
tag_10 = TextTag(Location=flatten(cluster_4.G), Text=flatten(concat), Colour=swatch_16)

# ==== cluster Cluster
pt = ClusterInput()
pt_2 = ClusterInput()
pt_3 = Point(pt)
pt_4 = Point(pt_2)
python = GhPythonScript(pts=pt_3)  # -> out, max, min, cent; inputs pts: list of Point3d
# ---------- python: Python ----------
__author__ = "kazuj"
__version__ = "2020.01.19"

import rhinoscriptsyntax as rs
import Rhino.Geometry as rg

bbx= rg.BoundingBox(pts);

max = bbx.Max 
min = bbx.Min
cent = bbx.Center
# ---------- end python ----------
pt_5 = Point(python.max)
pt_6 = Point(python.min)
pdecon = Deconstruct(Point=pt_3)  # -> XComponent, YComponent, ZComponent
pdecon_2 = Deconstruct(Point=pt_6)  # -> XComponent, YComponent, ZComponent
pdecon_3 = Deconstruct(Point=pt_3)  # -> XComponent, YComponent, ZComponent
pdecon_4 = Deconstruct(Point=pt_5)  # -> XComponent, YComponent, ZComponent
equals = Equality(FirstNumber=pdecon.XComponent, SecondNumber=pdecon_2.XComponent)  # -> Equality, Inequality
equals_2 = Equality(FirstNumber=pdecon_3.XComponent, SecondNumber=pdecon_4.XComponent)  # -> Equality, Inequality
equals_3 = Equality(FirstNumber=pdecon.YComponent, SecondNumber=pdecon_2.YComponent)  # -> Equality, Inequality
equals_4 = Equality(FirstNumber=pdecon_3.YComponent, SecondNumber=pdecon_4.YComponent)  # -> Equality, Inequality
sqr = Square(Value=Slider(2, range=0..10))
sqr_2 = Square(Value=Slider(2, range=0..10))
toggle = BooleanToggle(True)
merge = Merge(
    Data1=graft(equals_2.Equality),
    Data2=graft(equals_4.Equality),
    Data3=graft(equals.Equality),
    Data4=graft(equals_3.Equality))
addition = Addition(A=sqr, B=sqr_2)
vec2pt = Vector2Pt(PointA=python.max, PointB=python.min, Unitize=toggle)  # -> Vector, Length
vec2pt_2 = Vector2Pt(PointA=python.min, PointB=python.max, Unitize=toggle)  # -> Vector, Length
sqrt = SquareRoot(Value=addition)
ma = MassAddition(Input=merge)  # -> flatten(Result), PartialResults
amp = Amplitude(Vector=vec2pt.Vector, Amplitude=sqrt)
cull = CullPattern(List=pt_3, CullPattern=ma.Result)
pt_7 = Point(pt_4)
move = Move(Geometry=python.min, Motion=amp)  # -> Geometry, Transform
merge_2 = Merge(Data1=cull, Data2=python.max, Data3=python.min)  # -> flatten(Result)
pdecon_5 = Deconstruct(Point=merge_2)  # -> XComponent, YComponent, ZComponent
cps = ClosestPoints(Point=merge_2, Cloud=pt_7, Count=Slider(5, range=0..10))  # -> ClosestPoint, CPIndex, Distance
cp = ClosestPoint(Point=merge_2, Cloud=pt_7)  # -> ClosestPoint, CPIndex, Distance
num = Number(pdecon_5.XComponent)
num_2 = Number(pdecon_5.YComponent)
smaller = SmallerThan(FirstNumber=cp.Distance, SecondNumber=Slider(3.5, range=0..10))  # -> SmallerThan, OrEqualTo
cull_2 = CullPattern(List=cp.CPIndex, CullPattern=smaller.SmallerThan)
sort = SortList(Keys=num_2, ValuesA=num_2)  # -> Keys, ValuesA
sort_2 = SortList(Keys=num, ValuesA=num)  # -> Keys, ValuesA
item = ListItem(List=pt_7, Index=cull_2, Wrap=True)
item_2 = ListItem(List=reverse(sort.ValuesA), Index=0, Wrap=True)
item_3 = ListItem(List=reverse(sort_2.ValuesA), Index=0, Wrap=True)
item_4 = ListItem(List=sort.ValuesA, Index=0, Wrap=True)
item_5 = ListItem(List=sort_2.ValuesA, Index=0, Wrap=True)
equals_5 = Equality(FirstNumber=item_5, SecondNumber=num)  # -> Equality, Inequality
equals_6 = Equality(FirstNumber=item_3, SecondNumber=num)  # -> Equality, Inequality
equals_7 = Equality(FirstNumber=item_4, SecondNumber=num_2)  # -> Equality, Inequality
equals_8 = Equality(FirstNumber=item_2, SecondNumber=num_2)  # -> Equality, Inequality
number_slider = Slider(2, range=0..10)
cull_3 = CullPattern(List=merge_2, CullPattern=equals_5.Equality)
cull_4 = CullPattern(List=merge_2, CullPattern=equals_6.Equality)
cull_5 = CullPattern(List=merge_2, CullPattern=equals_7.Equality)
cull_6 = CullPattern(List=merge_2, CullPattern=equals_8.Equality)
pdecon_6 = Deconstruct(Point=cull_3)  # -> XComponent, YComponent, ZComponent
pdecon_7 = Deconstruct(Point=cull_4)  # -> XComponent, YComponent, ZComponent
pdecon_8 = Deconstruct(Point=cull_5)  # -> XComponent, YComponent, ZComponent
pdecon_9 = Deconstruct(Point=cull_6)  # -> XComponent, YComponent, ZComponent
subtraction = Subtraction(A=pdecon_8.YComponent, B=number_slider)
subtraction_2 = Subtraction(A=pdecon_6.XComponent, B=number_slider)
addition_2 = Addition(A=pdecon_9.YComponent, B=number_slider)
addition_3 = Addition(A=pdecon_7.XComponent, B=number_slider)
pt_8 = ConstructPoint(XCoordinate=subtraction_2, YCoordinate=pdecon_6.YComponent, ZCoordinate=0)
pt_9 = ConstructPoint(XCoordinate=addition_3, YCoordinate=pdecon_7.YComponent, ZCoordinate=0)
pt_10 = ConstructPoint(XCoordinate=pdecon_9.XComponent, YCoordinate=addition_2, ZCoordinate=0)
pt_11 = ConstructPoint(XCoordinate=pdecon_8.XComponent, YCoordinate=subtraction, ZCoordinate=0)
boudingboxpt = BoudingBoxPt(pts=[pt_8, pt_10, pt_9, pt_11])  # -> out, max, min, cent; inputs pts: list of Point3d; same code as python
merge_3 = Merge(Data1=pt_8, Data2=pt_9, Data3=pt_11, Data4=pt_10)
pdecon_10 = Deconstruct(Point=boudingboxpt.max)  # -> XComponent, YComponent, ZComponent
pdecon_11 = Deconstruct(Point=boudingboxpt.min)  # -> XComponent, YComponent, ZComponent
pt_12 = ConstructPoint(XCoordinate=pdecon_10.XComponent, YCoordinate=pdecon_11.YComponent, ZCoordinate=0)
pt_13 = ConstructPoint(XCoordinate=pdecon_11.XComponent, YCoordinate=pdecon_10.YComponent, ZCoordinate=0)
pt_14 = ConstructPoint(XCoordinate=pdecon_11.XComponent, YCoordinate=pdecon_11.YComponent, ZCoordinate=0)
pt_15 = ConstructPoint(XCoordinate=pdecon_10.XComponent, YCoordinate=pdecon_10.YComponent, ZCoordinate=0)
merge_4 = Merge(Data1=pt_15, Data2=pt_12, Data3=pt_13, Data4=pt_14)
merge_5 = Merge(Data1=merge_4, Data2=merge_3)  # -> flatten(Result)
pt_16 = Point(pt_4)
c_script = CSharpScript(x=merge_5, y=pt_16)  # -> out, A; inputs x: list of Vector3d, y: list of Vector3d
# ---------- c_script: C# ----------
    var rtnList = new List<Vector3d>();
    
    for(int i = 0; i < x.Count; i++)
    {
      if(y.Contains(x[i]))
      {
        rtnList.Add(x[i]);
      }
    }

    A = rtnList;
# ---------- end c_script ----------
A = ClusterOutput(c_script.A)

# ==== cluster Cluster_2
x = ClusterInput()
B = ClusterInput()
neg = Negative(Value=x)
dom = ConstructDomain(DomainStart=neg, DomainEnd=B)
T = ClusterInput()
tstat = TreeStatistics(Tree=T)  # -> Paths, Length, Count
P = ClusterInput()
range = Range(Domain=Slider(0.9, range=0..1), Steps=expr("x-1", tstat.Count))
planesrf = PlaneSurface(Plane=P, XSize=dom, YSize=dom)
I = ClusterInput()
F = ClusterInput()
join = BrepJoin(Breps=planesrf)  # -> Breps, Closed
hsl = ColourHSL(Alpha=1, Hue=range, Saturation=1, Luminance=0.5)
avr = Average(Input=I)
C = ClusterOutput(hsl)
Y = UnitY(Factor=F)
area = Area(Geometry=join.Breps)  # -> flatten(Area), Centroid
move = Move(Geometry=avr, Motion=Y)  # -> Geometry, Transform
swatch = ColourSwatch(SwatchColor=RGB(0, 0, 0))
A = ClusterOutput(area.Area)
F_2 = ClusterInput()
F_3 = ClusterInput()
F_4 = ClusterInput()
dots = DotDisplay(Point=avr, Colour=ColourSwatch(SwatchColor=RGB(0, 255, 213)), Size=Slider(10, range=0..10))
X = UnitX(Factor=F_2)
X_2 = UnitX(Factor=F_3)
X_3 = UnitX(Factor=F_4)
move_2 = Move(Geometry=move.Geometry, Motion=X)  # -> Geometry, Transform
move_3 = Move(Geometry=join.Breps, Motion=X_2)  # -> Geometry, Transform
move_4 = Move(Geometry=avr, Motion=X_3)  # -> Geometry, Transform
G = ClusterOutput(move_2.Geometry)
G_2 = ClusterOutput(move_3.Geometry)
G_3 = ClusterOutput(move_4.Geometry)
