# Grasshopper definition relaxtest.gh (Grasshopper 1.0.7)
# plug-ins: Kangaroo2 Components

number_slider = Slider(1000, range=0..10000)
mingridnum = Integer(Slider(1, range=0..10))
c_script = CSharpScript(x=number_slider)  # -> A; inputs x: Double
# ---------- c_script: C# ----------
  A = Math.Sqrt((x * x) * 2);
# ---------- end c_script ----------
multiplication = Multiplication(A=c_script, B=mingridnum)
pt = Point([Point(5566.477625, 14709.44221, 0), Point(17181.71841, 20156.95345, 0), Point(10607.23859, 14597, 0), Point(10688.81707, 19488.93655, 0), Point(11627.17178, 20855.96708, 0), Point(16085.812, 17766.14333, 0), Point(15909.16383, 22142.78653, 0), Point(20696.00636, 12873.32887, 0), Point(14350.26146, 20890.08374, 0)])
addition = Addition(A=c_script, B=multiplication)
integer_division = IntegerDivision(A=number_slider, B=Slider(2, range=0..10))
crv = Curve(<curve referenced from the Rhino model>)
# 1, Offset pts to in off crv
# 2, relax in offst crv
# 3. bool judge is using origin crv
gridsize = CSharpScript(iStartingPositions=pt, region=crv, gridSize=number_slider)  # -> out, A; inputs iStartingPositions: list of Point3d, region: Polyline, gridSize: Int32
# ---------- gridsize: C# ----------
    var rtnList = new List<Point3d>();
    foreach(var pt in iStartingPositions)
    {
      if(!IsInside(pt, region))
      {
        var nearPt = region.ClosestPoint(pt);
        var vec = (nearPt - pt);
        vec.Unitize();
        nearPt += vec * gridSize / 2;
        rtnList.Add(nearPt);
      }
      else
      {
        rtnList.Add(pt);
      }
    }

    A = rtnList;
# ---------- gridsize: C# additional code ----------
  bool IsInside(Point3d pt, Polyline crv)
  {
    Point3d pt1, pt2;
    bool oddNodes = false;

    for (int i = 0; i < crv.SegmentCount; i++) //for each contour line
    {

      pt1 = crv.SegmentAt(i).From; //get start and end pt
      pt2 = crv.SegmentAt(i).To;

      if ( (pt1[1] < pt[1] && pt2[1] >= pt[1] || pt2[1] < pt[1] && pt1[1] >= pt[1]) && (pt1[0] <= pt[0] || pt2[0] <= pt[0]) ) //if pt is between pts in y, and either of pts is before pt in x
        oddNodes ^= ( pt2[0] + (pt[1] - pt2[1]) * (pt1[0] - pt2[0]) / (pt1[1] - pt2[1]) < pt[0] ); //^= is xor
      //end.X + (pt-end).Y   * (start-end).X  /(start-end).Y   <   pt.X
    }


    if (!oddNodes)
    {
      double minDist = 1e10;
      for (int i = 0; i < crv.SegmentCount; i++) {
        Point3d cp = crv.SegmentAt(i).ClosestPoint(pt, true);
        //Point3d cp = mvContour[i].closestPoint(pt);
        //minDist = min(minDist, cp.distance(pt));
        minDist = Math.Min(minDist, cp.DistanceTo(pt));
      }
      if (minDist < 1e-10)
        return true;
    }

    if(oddNodes) return true;

    return false;
  }
# ---------- end gridsize ----------
c_script_2 = CSharpScript(
    iStartingPositions=pt,
    region=crv,
    minDist=addition,
    moveVal=integer_division,
    maxIteration=Slider(10000, range=0..10000))  # -> out, oCenters; inputs iStartingPositions: list of Point3d, region: Polyline, minDist: Int32, moveVal: Double, maxIteration: Int32
# ---------- c_script_2: C# usings ----------
using System.IO;
using System.Linq;
using System.Data;
using System.Drawing;
using System.Reflection;
using System.Windows.Forms;
using System.Xml;
using System.Xml.Linq;
using System.Runtime.InteropServices;

using Rhino.DocObjects;
using Rhino.Collections;
using GH_IO;
using GH_IO.Serialization;
# ---------- c_script_2: C# ----------
    List < Point3d > centers = new List<Point3d>();

    foreach(var pt in iStartingPositions)
    {
      if(!IsInside(pt, region))
      {
        var nearPt = region.ClosestPoint(pt);
        var vec = (nearPt - pt);
        vec.Unitize();
        nearPt += vec * moveVal;
        centers.Add(nearPt);
      }
      else
      {
        centers.Add(pt);
      }
    }

    int count = 0;
    while(true)
    {
      count++;

      if(count > maxIteration)
      {
        Print("count= " + count.ToString());
        break;
      }

      List<Vector3d> totalMoves = new List<Vector3d>();
      List<double> collisionCounts = new List<double>();

      for (int i = 0; i < centers.Count; i++)
      {
        totalMoves.Add(new Vector3d(0.0, 0.0, 0.0));
        collisionCounts.Add(0.0);
      }

      double collisionDistance = minDist;

      for (int i = 0; i < centers.Count; i++)
      {
        for (int j = i + 1; j < centers.Count; j++)
        {
          double d = centers[i].DistanceTo(centers[j]);
          if (d > collisionDistance) continue;
          Vector3d move = centers[i] - centers[j];
          move.Unitize();
          move *= moveVal;
          // move *= moveVal * (collisionDistance - d);
          totalMoves[i] += move;
          totalMoves[j] -= move;
          collisionCounts[i] += 1.0;
          collisionCounts[j] += 1.0;
        }
      }

      for (int i = 0; i < centers.Count; i++)
      {
        if (collisionCounts[i] != 0.0)
        {
          var ptBuff = centers[i];
          centers[i] += totalMoves[i] / collisionCounts[i];;
          if(!IsInside(centers[i], region))
          {
            /*
            var ptsBuff = centers;
            ptsBuff.RemoveAt(i);
            var pc = new PointCloud(ptsBuff);
            var nearIdx =  pc.ClosestPoint(ptBuff);
            var vec = ptsBuff[nearIdx]
            centers[i] =
       */
            centers[i] = ptBuff;
            //centers[i] = region.ClosestPoint(centers[i]);
          }
        }
      }

      var sum = 0.0;
      foreach(var val in collisionCounts)
      {
        sum += val;
      }

      if(sum == 0)
      {
        Print(count.ToString());
        break;
      }
    }

    oCenters = centers;
# ---------- c_script_2: C# additional code ----------
  bool IsInside (Point3d pt, Polyline crv)
  {
    Point3d pt1, pt2;
    bool oddNodes = false;

    for (int i = 0; i < crv.SegmentCount; i++) //for each contour line
    {

      pt1 = crv.SegmentAt(i).From; //get start and end pt
      pt2 = crv.SegmentAt(i).To;

      if ( (pt1[1] < pt[1] && pt2[1] >= pt[1] || pt2[1] < pt[1] && pt1[1] >= pt[1]) && (pt1[0] <= pt[0] || pt2[0] <= pt[0]) ) //if pt is between pts in y, and either of pts is before pt in x
        oddNodes ^= ( pt2[0] + (pt[1] - pt2[1]) * (pt1[0] - pt2[0]) / (pt1[1] - pt2[1]) < pt[0] ); //^= is xor
      //end.X + (pt-end).Y   * (start-end).X  /(start-end).Y   <   pt.X
    }


    if (!oddNodes)
    {
      double minDist = 1e10;
      for (int i = 0; i < crv.SegmentCount; i++) {
        Point3d cp = crv.SegmentAt(i).ClosestPoint(pt, true);
        //Point3d cp = mvContour[i].closestPoint(pt);
        //minDist = min(minDist, cp.distance(pt));
        minDist = Math.Min(minDist, cp.DistanceTo(pt));
      }
      if (minDist < 1e-10)
        return true;
    }

    if(oddNodes) return true;

    return false;
  }
# ---------- end c_script_2 ----------
panel = Panel(c_script_2.out)
points = PointList(Points=gridsize.A, Size=Slider(1000, range=0..1000))
dot = DotDisplay(Point=gridsize.A)
sph = Sphere(Base=c_script_2.oCenters, Radius=Slider(688, range=0..10000))
lng = ListLength(List=sph)  # -> expr("x", Length)
range = Range(Domain=Domain(0, 1), Steps=lng)
cull_i = CullIndex(List=range, Indices=lng, Wrap=True)
hsl = ColourHSL(Alpha=1, Hue=cull_i, Saturation=1, Luminance=0.5)
preview = CustomPreview(Geometry=sph, Material=hsl)
